# Grasshopper definition basic-get.gh (Grasshopper 1.0.8)
# plug-ins: Assertive Possum, Swiftlet

panel = Panel("http://httpbin.org/get")
get_string = GetString(AtLeast=1, AtMost=1, TreeAccess=False)
get = GETRequest(URL=get_string, TimeoutSeconds=100)  # -> Status, Content, Response
pjs = ParseJSONString(Text=get.Content)
aeq = AssertEqual(Name="GET", Actual=get.Status, Expected=Slider(200, range=0..1000), Tolerance=1e-06)
jo = JSONObject(pjs)
gjok = GetJSONObjectKey(JObject=jo, Key="headers")
panel_2 = Panel(aeq)
gjok_2 = GetJSONObjectKey(JObject=gjok, Key="Host")
rjv = ReadJSONValue(JValue=gjok_2)  # -> AsString, AsNumber, AsBool
aeq_2 = AssertEqual(Name="GET JSON Parsing", Actual=rjv.AsString, Expected="httpbin.org", Tolerance=1e-06)
context_print = ContextPrint()
