# Grasshopper definition no-swiftlet.gh (Grasshopper 1.0.8)
# plug-ins: Assertive Possum

actual = GetBoolean(AtLeast=1, AtMost=1, FalseValue="False", TreeAccess=False, TrueValue="True")
expected = GetBoolean(AtLeast=1, AtMost=1, FalseValue="False", TreeAccess=False, TrueValue="True")
aeq = AssertEqual(Name="bool", Actual=actual, Expected=expected, Tolerance=1e-06)
context_print = ContextPrint(Result=aeq)
