# Grasshopper definition test-runner.gh (Grasshopper 1.0.8)
# plug-ins: Assertive Possum

rhino_compute_url = Panel("http://localhost:5000")
toggle = BooleanToggle(False)
path = FilePath("C:\Users\spigach\GitHub\Swiftlet\AssertivePossumTests\tests\")
run = TestRunner(Source=path, Server=rhino_compute_url, Run=toggle)  # -> Reports, Summary, AllPassed
path_2 = FilePath("C:\Users\spigach\GitHub\Swiftlet\AssertivePossumTests\report.md")
panel = Panel(path_2)
md = ReportToMarkdown(Report=run.Reports, Path=path_2, Write=toggle)
view = ReportViewer(Report=run.Reports)  # -> Passed, Failed, Errors
passed = Panel(view.Passed)
failed = Panel(view.Failed)
error = Panel(view.Errors)
lng = ListLength(List=passed)
lng_2 = ListLength(List=failed)
lng_3 = ListLength(List=error)
panel_2 = Panel(lng)
panel_3 = Panel(lng_2)
panel_4 = Panel(lng_3)
