# Grasshopper definition auth.gh (Grasshopper 1.0.8)
# plug-ins: Assertive Possum, Swiftlet

api = APIKey(Key="some-key", Value="some-value")  # -> Header, QueryParam
basic = BasicAuth(Username="some-key", Password="some-value")
bearer = BearerTokenAuth(Token="token")
annl = AssertNotNull(Name="basic-auth\header-not-null", Value=basic)
annl_2 = AssertNotNull(Name="api-key\query-param-not-null", Value=api.QueryParam)
annl_3 = AssertNotNull(Name="api-key\header-not-null", Value=api.Header)
annl_4 = AssertNotNull(Name="bearer-token-auth\header-not-null", Value=bearer)
test_result_to_json = TestResultToJSON(Result=annl)
test_result_to_json_2 = TestResultToJSON(Result=annl_4)
test_result_to_json_3 = TestResultToJSON(Result=annl_3)
test_result_to_json_4 = TestResultToJSON(Result=annl_2)
dhh = DeconstructHttpHeader(Header=api.Header)  # -> Key, Value
dqp = DeconstructQueryParam(Param=api.QueryParam)  # -> Key, Value
context_print = ContextPrint(BasicAuthHeaderNotNull=test_result_to_json)
dhh_2 = DeconstructHttpHeader(Header=basic)  # -> Key, Value
dhh_3 = DeconstructHttpHeader(Header=bearer)  # -> Key, Value
concat = Concatenate(FragmentA="Bearer ", FragmentB="token")
context_print_2 = ContextPrint(BearerTokenAuthHeaderNotNull=test_result_to_json_2)
context_print_3 = ContextPrint(ApiKeyHeaderNotNull=test_result_to_json_3)
context_print_4 = ContextPrint(ApiKeyQueryParamNotNull=test_result_to_json_4)
aeq = AssertEqual(Name="api-key\header-key-name", Actual=dhh.Key, Expected="some-key", Tolerance=1e-06)
aeq_2 = AssertEqual(Name="api-key\header-value", Actual=dhh.Value, Expected="some-value", Tolerance=1e-06)
aeq_3 = AssertEqual(Name="api-key\query-param-key-name", Actual=dqp.Key, Expected="some-key", Tolerance=1e-06)
aeq_4 = AssertEqual(Name="api-key\query-param-value", Actual=dqp.Value, Expected="some-value", Tolerance=1e-06)
aeq_5 = AssertEqual(Name="basic-auth\header-key-name", Actual=dhh_2.Key, Expected="Authorization", Tolerance=1e-06)
aeq_6 = AssertEqual(Name="basic-auth\header-value", Actual=dhh_2.Value, Expected="Basic c29tZS1rZXk6c29tZS12YWx1ZQ==", Tolerance=1e-06)
aeq_7 = AssertEqual(Name="bearer-token-auth\header-key-name", Actual=dhh_3.Key, Expected="Authorization", Tolerance=1e-06)
aeq_8 = AssertEqual(Name="bearer-token-auth\header-value", Actual=dhh_3.Value, Expected=concat, Tolerance=1e-06)
test_result_to_json_5 = TestResultToJSON(Result=aeq)
test_result_to_json_6 = TestResultToJSON(Result=aeq_2)
test_result_to_json_7 = TestResultToJSON(Result=aeq_3)
test_result_to_json_8 = TestResultToJSON(Result=aeq_4)
test_result_to_json_9 = TestResultToJSON(Result=aeq_5)
test_result_to_json_10 = TestResultToJSON(Result=aeq_6)
test_result_to_json_11 = TestResultToJSON(Result=aeq_7)
test_result_to_json_12 = TestResultToJSON(Result=aeq_8)
context_print_5 = ContextPrint(BearerTokenAuthHeaderKeyName=test_result_to_json_11)
context_print_6 = ContextPrint(BearerTokenAuthHeaderValue=test_result_to_json_12)
context_print_7 = ContextPrint(ApiKeyQueryParamKeyName=test_result_to_json_7)
context_print_8 = ContextPrint(BasicAuthHeaderKeyName=test_result_to_json_9)
context_print_9 = ContextPrint(ApiKeyQueryParamValue=test_result_to_json_8)
context_print_10 = ContextPrint(ApiKeyHeaderKeyName=test_result_to_json_5)
context_print_11 = ContextPrint(BasicAuthHeaderValue=test_result_to_json_10)
context_print_12 = ContextPrint(ApiKeyHeaderValue=test_result_to_json_6)
