# Grasshopper definition html.gh (Grasshopper 1.0.8)
# plug-ins: Assertive Possum, Swiftlet

panel = Panel("""<!DOCTYPE html>
<html lang="en">
<head>
  <meta charset="utf-8">
  <title>Swiftlet HTML Test</title>
  <meta name="viewport" content="width=device-width, initial-scale=1">
  <meta name="description" content="HTML parsing regression fixture">
  <link rel="canonical" href="https://example.com/products/widget-42">
</head>
<body id="page-root" class="theme-light page product-page" data-env="test">
  <header id="hero" class="hero section featured" data-role="banner">
    <h1 class="title">Widget 42</h1>
    <p class="subtitle">A compact fixture for Swiftlet HTML parsing tests.</p>
    <nav id="main-nav" class="nav cluster" aria-label="Primary">
      <a id="home-link" class="nav-link action" href="/home" data-kind="internal">Home</a>
      <a id="docs-link" class="nav-link action featured-link" href="/docs" data-kind="internal">Docs</a>
      <a id="buy-link" class="nav-link cta" href="https://example.com/buy?sku=42&amp;ref=test" data-kind="external" target="_blank" rel="noreferrer">Buy now</a>
    </nav>
  </header>
  <main id="content" class="layout stack">
    <section id="catalog" class="section cards" data-role="catalog">
      <article id="card-1" class="card featured sale" data-role="card" data-sku="W42">
        <h2 class="card-title">Starter Pack</h2>
        <p class="price" data-currency="USD">$19.99</p>
        <ul id="specs" class="spec-list compact">
          <li class="spec-item" data-key="weight"><span class="label">Weight</span><span class="value">1.2kg</span></li>
          <li class="spec-item" data-key="color"><span class="label">Color</span><span class="value">Red</span></li>
          <li class="spec-item" data-key="material"><span class="label">Material</span><span class="value">Aluminum</span></li>
        </ul>
        <a id="card-1-link" class="action cta primary" href="/products/widget-42" data-kind="cta">View details</a>
      </article>
      <article id="card-2" class="card secondary" data-role="card" data-sku="W42-B">
        <h2 class="card-title">Pro Pack</h2>
        <p class="price" data-currency="EUR">€29.99</p>
        <img id="product-image" class="media thumb" src="/img/widget.png" alt="Widget product image" width="320" height="180">
        <div id="badge-box" class="badges">
          <span class="badge new" data-level="info">New</span>
          <span class="badge limited" data-level="warning">Limited</span>
        </div>
        <a id="card-2-link" class="action secondary-link" href="/products/widget-42-pro" data-kind="cta">Compare</a>
      </article>
    </section>
    <section id="details" class="section prose">
      <form id="signup-form" class="form stack" action="/signup" method="post" data-role="form">
        <label for="email-input">Email</label>
        <input id="email-input" class="input email" name="email" type="email" value="test@example.com" required>
        <input id="terms-input" class="input checkbox" name="terms" type="checkbox" checked>
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""")
html = ReadHTML(HTML=panel)
gch = GetChildNodes(Parent=html)
annl = AssertNotNull(Name="read-html\is-not-null", Value=html)
byclass = GetElementsByClassName(Parent=html, Class="card", Recursive=True)
byattr = GetElementsByAttributeValue(Parent=html, Attribute="data-kind", Value="cta", Recursive=True)
byxpath = GetElementsByXPATH(Parent=html, XPATH="//ul[@id='specs']/li[@data-key='material']")
bytag = GetElementsByTagName(Parent=html, Tag="li", Recursive=True)
byid = GetElementById(Parent=html, ID="hero")
test_result_to_json = TestResultToJSON(Result=annl)
context_print = ContextPrint(ReadHtmlIsNotNull=test_result_to_json)
gattrs = GetHtmlAttributes(Node=byxpath)  # -> Names, Values
alen = AssertListLength(Name="get-element-by-attribute-value\list-length-matches", List=byattr, Length="2")
alen_2 = AssertListLength(Name="get-element-by-tag-name\list-length-matches", List=bytag, Length="3")
annl_2 = AssertNotNull(Name="get-elements-by-xpath\is-not-null", Value=byxpath)
alen_3 = AssertListLength(Name="get-element-by-class-name\list-length-matches", List=byclass, Length="2")
annl_3 = AssertNotNull(Name="get-element-by-id\is-not-null", Value=byid)
alen_4 = AssertListLength(Name="get-child-nodes\list-length-matches", List=gch, Length="4")
gattr = GetAttributeValue(Node=byid, Attribute="data-role")
item = ListItem(List=bytag, Index=0, Wrap=True)
test_result_to_json_2 = TestResultToJSON(Result=annl_2)
test_result_to_json_3 = TestResultToJSON(Result=annl_3)
test_result_to_json_4 = TestResultToJSON(Result=alen)
test_result_to_json_5 = TestResultToJSON(Result=alen_3)
test_result_to_json_6 = TestResultToJSON(Result=alen_2)
alen_5 = AssertListLength(Name="get-html-attrbutes\list-length-matches", List=gattrs.Names, Length="2")
test_result_to_json_7 = TestResultToJSON(Result=alen_4)
aeq = AssertEqual(Name="get-attribute-value\value-matches", Actual=gattr, Expected="banner", Tolerance=1e-06)
context_print_2 = ContextPrint(GetElementByAttributeValueListLengthMatches=test_result_to_json_4)
context_print_3 = ContextPrint(GetElementsByXpathIsNotNull=test_result_to_json_2)
context_print_4 = ContextPrint(GetElementByIdIsNotNull=test_result_to_json_3)
context_print_5 = ContextPrint(GetElementByClassNameListLengthMatches=test_result_to_json_5)
byclass_2 = GetElementsByClassName(Parent=item, Class="label", Recursive=True)
context_print_6 = ContextPrint(GetElementByTagNameListLengthMatches=test_result_to_json_6)
context_print_7 = ContextPrint(GetChildNodesListLengthMatches=test_result_to_json_7)
test_result_to_json_8 = TestResultToJSON(Result=alen_5)
test_result_to_json_9 = TestResultToJSON(Result=aeq)
inner = GetInnerHTML(Node=byclass_2)
context_print_8 = ContextPrint(GetHtmlAttrbutesListLengthMatches=test_result_to_json_8)
context_print_9 = ContextPrint(GetAttributeValueValueMatches=test_result_to_json_9)
aeq_2 = AssertEqual(Name="get-inner-html\value-matches", Actual=inner, Expected="Weight", Tolerance=1e-06)
shtml = StringifyHTMLNode(HTMLNode=byclass_2)
test_result_to_json_10 = TestResultToJSON(Result=aeq_2)
context_print_10 = ContextPrint(GetInnerHtmlValueMatches=test_result_to_json_10)
panel_2 = Panel(shtml)
aeq_3 = AssertEqual(
    Name="stringify-html-node\value-matches",
    Actual=panel_2,
    Expected="<span class=\"label\">Weight</span>",
    Tolerance=1e-06)
test_result_to_json_11 = TestResultToJSON(Result=aeq_3)
context_print_11 = ContextPrint(StringifyHtmlNodeValueMatches=test_result_to_json_11)
