# Grasshopper definition json.gh (Grasshopper 1.0.8)
# plug-ins: Assertive Possum, Swiftlet

panel = Panel("""name
age
admin""")
number_slider = Slider(33, range=0..100)
toggle = BooleanToggle(True)
cjv = CreateJSONValue(Value="John Doe")
cjv_2 = CreateJSONValue(Value=number_slider)
cjv_3 = CreateJSONValue(Value=toggle)
rjv = ReadJSONValue(JValue=cjv_2)  # -> AsString, AsNumber, AsBool
rjv_2 = ReadJSONValue(JValue=cjv)  # -> AsString, AsNumber, AsBool
rjv_3 = ReadJSONValue(JValue=cjv_3)  # -> AsString, AsNumber, AsBool
annl = AssertNotNull(Name="create-json-value\name\is-not-null", Value=cjv)
annl_2 = AssertNotNull(Name="create-json-value\age\is-not-null", Value=cjv_2)
annl_3 = AssertNotNull(Name="create-json-value\is-admin\is-not-null", Value=cjv_3)
test_result_to_json = TestResultToJSON(Result=annl_2)
test_result_to_json_2 = TestResultToJSON(Result=annl)
test_result_to_json_3 = TestResultToJSON(Result=annl_3)
merge = Merge(Data1=cjv, Data2=cjv_2, Data3=cjv_3)
cjo = CreateJSONObject(Keys=panel, Values=merge)
panel_2 = Panel(rjv_2.AsString)
context_print = ContextPrint(CreateJsonValueAgeIsNotNull=test_result_to_json)
context_print_2 = ContextPrint(CreateJsonValueNameIsNotNull=test_result_to_json_2)
context_print_3 = ContextPrint(CreateJsonValueIsAdminIsNotNull=test_result_to_json_3)
rjo = ReadJSONObject(JObject=cjo)  # -> Keys, JTokens
annl_4 = AssertNotNull(Name="create-json-object\not-null", Value=cjo)
lng = ListLength(List=merge)
lng_2 = ListLength(List=panel)
aeq = AssertEqual(Name="read-json-value\age\value-matches", Actual=rjv.AsNumber, Expected=number_slider, Tolerance=1e-06)
aeq_2 = AssertEqual(Name="read-json-value\name\value-matches", Actual=panel_2, Expected="John Doe", Tolerance=1e-06)
aeq_3 = AssertEqual(Name="read-json-value\is-admin\value-matches", Actual=rjv_3.AsBool, Expected=toggle, Tolerance=1e-06)
test_result_to_json_4 = TestResultToJSON(Result=annl_4)
test_result_to_json_5 = TestResultToJSON(Result=aeq)
test_result_to_json_6 = TestResultToJSON(Result=aeq_3)
test_result_to_json_7 = TestResultToJSON(Result=aeq_2)
cjv_4 = CreateJSONValue(Value=panel)
context_print_4 = ContextPrint(CreateJsonObjectNotNull=test_result_to_json_4)
alen = AssertListLength(Name="read-json-object\keys-list-matches", List=rjo.Keys, Length=lng)
alen_2 = AssertListLength(Name="read-json-object\values-list-matches", List=rjo.Keys, Length=lng_2)
context_print_5 = ContextPrint(ReadJsonValueNameValueMatches=test_result_to_json_7)
context_print_6 = ContextPrint(ReadJsonValueAgeValueMatches=test_result_to_json_5)
context_print_7 = ContextPrint(ReadJsonValueIsAdminValueMatches=test_result_to_json_6)
lng_3 = ListLength(List=cjv_4)
test_result_to_json_8 = TestResultToJSON(Result=alen)
test_result_to_json_9 = TestResultToJSON(Result=alen_2)
context_print_8 = ContextPrint(ReadJsonObjectKeysListMatches=test_result_to_json_8)
context_print_9 = ContextPrint(ReadJsonObjectValuesListMatches=test_result_to_json_9)
cja = CreateJSONArray(JTokens=cjv_4)
sjk = SetJSONKey(JObject=cjo, Key="keys", JToken=cja)
merge_2 = Merge(Data1=merge, Data2=cja, Data3=sjk)
annl_5 = AssertNotNull(Name="create-json-array\not-null", Value=cja)
annl_6 = AssertNotNull(Name="set-json-key\not-null", Value=sjk)
sjt = SeparateJSONTokens(JTokens=merge_2)  # -> JObjects, JArrays, JValues
rjo_2 = ReadJSONObject(JObject=sjk)  # -> Keys, JTokens
test_result_to_json_10 = TestResultToJSON(Result=annl_6)
context_print_10 = ContextPrint(CreateJsonArrayNotNull=annl_5)
addition = Addition(A=lng_2, B=1)
context_print_11 = ContextPrint(SetJsonKeyNotNull=test_result_to_json_10)
rjk = RemoveJSONKey(JObject=sjk, Key="age")
alen_3 = AssertListLength(Name="set-json-key\number-of-keys-matches", List=rjo_2.Keys, Length=addition)
sjt_2 = StringifyJSONToken(JToken=sjk)
rjo_3 = ReadJSONObject(JObject=rjk)  # -> Keys, JTokens
test_result_to_json_11 = TestResultToJSON(Result=alen_3)
panel_3 = Panel("""{
  "name": "John Doe",
  "age": 33,
  "admin": true,
  "keys": [
    "name",
    "age",
    "admin"
  ]
}""")
panel_4 = Panel(sjt_2)
context_print_12 = ContextPrint(SetJsonKeyNumberOfKeysMatches=test_result_to_json_11)
alen_4 = AssertListLength(Name="separate-json-token\number-of-objects-matches", List=sjt.JObjects, Length="1")
alen_5 = AssertListLength(Name="separate-json-token\number-of-arrays-matches", List=sjt.JArrays, Length="1")
alen_6 = AssertListLength(Name="separate-json-token\number-of-values-matches", List=sjt.JValues, Length=lng)
alen_7 = AssertListLength(Name="remove-json-key\number-of-keys-matches", List=rjo_3.Keys, Length=lng_2)
fjs = FormatJsonString(JSONString="{\"hello\":\"world\"}")
test_result_to_json_12 = TestResultToJSON(Result=alen_7)
test_result_to_json_13 = TestResultToJSON(Result=alen_4)
test_result_to_json_14 = TestResultToJSON(Result=alen_5)
test_result_to_json_15 = TestResultToJSON(Result=alen_6)
panel_5 = Panel(fjs)
panel_6 = Panel("""{
  "hello": "world"
}""")
aeq_4 = AssertEqual(Name="stringify-json-token\result-matches", Actual=sjt_2, Expected=panel_3, Tolerance=1e-06)
context_print_13 = ContextPrint(RemoveJsonKeyNumberOfKeysMatches=test_result_to_json_12)
context_print_14 = ContextPrint(SeparateJsonTokenNumberOfObjectsMatches=test_result_to_json_13)
context_print_15 = ContextPrint(SeparateJsonTokenNumberOfValuesMatches=test_result_to_json_15)
context_print_16 = ContextPrint(SeparateJsonTokenNumberOfArraysMatches=test_result_to_json_14)
pjs = ParseJSONString(Text=panel_4)
test_result_to_json_16 = TestResultToJSON(Result=aeq_4)
annl_7 = AssertNotNull(Name="parse-json-string\is-not-null", Value=pjs)
context_print_17 = ContextPrint(StringifyJsonTokenResultMatches=test_result_to_json_16)
gjok = GetJSONObjectKey(JObject=pjs, Key="keys")
aeq_5 = AssertEqual(Name="format-json-string\output-matches", Actual=panel_5, Expected=panel_6, Tolerance=1e-06)
test_result_to_json_17 = TestResultToJSON(Result=annl_7)
annl_8 = AssertNotNull(Name="get-json-object-key\is-not-null", Value=gjok)
rja = ReadJSONArray(Array=gjok)
context_print_18 = ContextPrint(ParseJsonStringIsNotNull=test_result_to_json_17)
test_result_to_json_18 = TestResultToJSON(Result=annl_8)
context_print_19 = ContextPrint(GetJsonObjectKeyIsNotNull=test_result_to_json_18)
alen_8 = AssertListLength(Name="read-json-array\list-length-matches", List=rja, Length=lng_3)
test_result_to_json_19 = TestResultToJSON(Result=alen_8)
context_print_20 = ContextPrint(ReadJsonArrayListLengthMatches=test_result_to_json_19)
