# Grasshopper definition paths.gh (Grasshopper 1.0.8)
# plug-ins: RhinoCodePluginGH, Assertive Possum

panel = Panel("""John Doe
123 Main St., Brooklyn, NY, 12345
ID12345""")
panel_2 = Panel("""Jane Doe
234 Main St., Brooklyn, NY, 13456
ID67890""")
panel_3 = Panel("""Hiro Protagonist
123 Snowcrash Lane, Brooklyn, NY, 13456
ID11111""")
py3 = Python3Script()  # -> a
# ---------- py3: Python ----------
import Grasshopper as gh

tree = gh.DataTree[object]()
tree.EnsurePath(gh.Kernel.Data.GH_Path(0))

a = tree
# ---------- end py3 ----------
py3_2 = Python3Script()  # -> a; same code as py3
replace = ReplacePaths(Data=panel_2, Search="{0}", Replace="{2}")
replace_2 = ReplacePaths(Data=panel_3, Search="{0}", Replace="{4}")
replace_3 = ReplacePaths(Data=py3, Search="{0}", Replace="{1}")
replace_4 = ReplacePaths(Data=py3_2, Search="{0}", Replace="{3}")
merge = Merge(Data1=panel, Data2=replace_3, Data3=replace, Data4=replace_4, Data5=replace_2)
panel_4 = Panel(merge)
branch = TreeBranch(Tree=merge, Path="1", MaintainPaths=True)
branch_2 = TreeBranch(Tree=merge, Path="3", MaintainPaths=True)
alen = AssertListLength(Name="replace-empty-branches\replaced-banches-length-matches-1", List=branch, Length="0")
alen_2 = AssertListLength(Name="replace-empty-branches\replaced-banches-length-matches-2", List=branch_2, Length="0")
test_result_to_json = TestResultToJSON(Result=alen)
test_result_to_json_2 = TestResultToJSON(Result=alen_2)
context_print = ContextPrint(ReplaceEmptyBranchesReplacedBanchesLengthMatches1=test_result_to_json)
context_print_2 = ContextPrint(ReplaceEmptyBranchesReplacedBanchesLengthMatches2=test_result_to_json_2)
