# Grasshopper definition request.gh (Grasshopper 1.0.8)
# plug-ins: RhinoCodePluginGH, Assertive Possum, Swiftlet

panel = Panel("""{
  "hello" : "world"
}""")
wsl_path = Panel("/mnt/c/Users/spigach/GitHub/Swiftlet/Assets/Logo/Logo_32x32.png")
panel_2 = Panel("""{
  "hello" : "world"
}""")
windows_path = Panel("C:\Users\spigach\GitHub\Swiftlet\Assets\Logo\Logo_32x32.png")
panel_3 = Panel("""{
    "callsign": "SWR142",
    "heading": 276,
    "altitude": null,
    "fuel": {
      "remainingKg": 3610,
      "flowKgPerHour": 1515,
      "tankBalanceOk": null
    },
    "position": {
      "lat": 47.462,
      "lon": 8.548,
      "runway": "14"
    },
    "autopilot": {
      "engaged": true,
      "mode": "APP"
    },
    "squawk": "4712",
    "origin": "LEBL",
    "alerts": [
      "glideslope_capture"
    ],
    "etaMinutes": 16,
    "remarks": "High approach due traffic"
  }""")
panel_4 = Panel("""{
    "callsign": "SWR142",
    "heading": 274,
    "altitude": 11200,
    "fuel": {
      "remainingKg": 3820,
      "flowKgPerHour": 1480,
      "tankBalanceOk": true
    },
    "position": {
      "lat": 47.451,
      "lon": 8.564,
      "waypoint": "LUGUS"
    },
    "autopilot": {
      "engaged": true,
      "mode": "LNAV"
    },
    "squawk": "4712",
    "destination": "LSZH",
    "alerts": [
      "crosswind",
      "light_turbulence"
    ],
    "etaMinutes": 18,
    "remarks": null
  }""")
txtba = TextToByteArray(Text="Yay!", Encoding="UTF8")
ch = CreateHttpHeader(Key="some-key", Value="some-value")
cqp = CreateQueryParam(Key="some-key", Value="some-value")
curl = CreateURL(Scheme="http", Host="localhost", Port=Slider(5000, range=0..10000), Route="example/route")
curl_2 = CreateURL(Scheme="http", Host="localhost", Port=Slider(5000, range=0..10000), Route="/example/route")
ctb = CreateTextBody(
    Content=panel,
    IsHtmlChecked=False,
    IsJavascriptChecked=False,
    IsJsonChecked=True,
    IsTextChecked=False,
    IsXmlChecked=False)
ctb_2 = CreateTextBody(
    Content="Hello World",
    IsHtmlChecked=False,
    IsJavascriptChecked=False,
    IsJsonChecked=False,
    IsTextChecked=True,
    IsXmlChecked=False)
ctb_3 = CreateTextBody(
    Content="console.log(\"Hello World\");",
    IsHtmlChecked=False,
    IsJavascriptChecked=True,
    IsJsonChecked=False,
    IsTextChecked=False,
    IsXmlChecked=False)
ctb_4 = CreateTextBody(
    Content="<p>Hello World</p>",
    IsHtmlChecked=True,
    IsJavascriptChecked=False,
    IsJsonChecked=False,
    IsTextChecked=False,
    IsXmlChecked=False)
ctb_5 = CreateTextBody(
    Content="<item>Hello World</item>",
    IsHtmlChecked=False,
    IsJavascriptChecked=False,
    IsJsonChecked=False,
    IsTextChecked=False,
    IsXmlChecked=True)
ctbc = CreateTextBodyCustom(Content="1,2,3,4,5", ContentType="text/csv")
cbab = CreateByteArrayBody(Content="1,2,3,4,5", ContentType="text/csv")
cmfby = CreateMultipartFieldBytes(Name="my-file", Bytes=txtba, FileName="my-file.txt", ContentType="text/plain")
cmft = CreateMultipartFieldText(Name="hello-world", Text=panel_2, ContentType="application/json")
url = Panel("http://localhost:5000/example/route")
annl = AssertNotNull(Name="create-http-header\header-is-not-null", Value=ch)
annl_2 = AssertNotNull(Name="create-query-param\header-is-not-null", Value=cqp)
panel_5 = Panel(ctb)
panel_6 = Panel(ctb_2)
panel_7 = Panel(ctb_3)
panel_8 = Panel(ctb_4)
panel_9 = Panel(ctb_5)
panel_10 = Panel(ctbc)
panel_11 = Panel(cbab)
panel_12 = Panel("""client_id
grant_type""")
panel_13 = Panel("""swiftlet
authorization_code""")
concat = Concatenate(FragmentA=curl, FragmentB="?param_1=yolo&param_2=yay")
test_result_to_json = TestResultToJSON(Result=annl_2)
test_result_to_json_2 = TestResultToJSON(Result=annl)
py3 = Python3Script(linux=wsl_path, windows=windows_path)  # -> path; inputs linux: String
# ---------- py3: Python ----------
"""Grasshopper Python Script - OS-based Path Selector
Inputs:
    windows: str - Path for Windows
    linux: str - Path for Linux
Output:
    path: str - Selected path based on current OS
"""

import platform

system = platform.system()
release = platform.release().lower()

if system == "Windows" or "microsoft" in release:
    path = windows
else:
    path = linux
# ---------- end py3 ----------
panel_14 = Panel("[\"client_id\",\"grant_type\"], Values = [\"swiftlet\",\"authorization_code\"]")
context_print = ContextPrint(CreateQueryParamHeaderIsNotNull=test_result_to_json)
context_print_2 = ContextPrint(CreateHttpHeaderHeaderIsNotNull=test_result_to_json_2)
aeq = AssertEqual(Name="create-url\url-no-leading-slash", Actual=curl, Expected=url, Tolerance=1e-06)
aeq_2 = AssertEqual(Name="create-url\url-no-leading-slash", Actual=curl_2, Expected=url, Tolerance=1e-06)
cfueb = CreateFormURLEncodedBody(Keys=panel_12, Values=panel_13)
annl_3 = AssertNotNull(Name="create-multipart-field-bytes\request-body-is-not-null", Value=cmfby)
annl_4 = AssertNotNull(Name="create-multipart-field-text\request-body-is-not-null", Value=cmft)
aeq_3 = AssertEqual(
    Name="create-text-body\json\request-body-to-string",
    Actual=panel_5,
    Expected="REQUEST BODY [ application/json ]",
    Tolerance=1e-06)
aeq_4 = AssertEqual(
    Name="create-text-body\text\request-body-to-string",
    Actual=panel_6,
    Expected="REQUEST BODY [ text/plain ]",
    Tolerance=1e-06)
aeq_5 = AssertEqual(
    Name="create-text-body\javascript\request-body-to-string",
    Actual=panel_7,
    Expected="REQUEST BODY [ text/javascript ]",
    Tolerance=1e-06)
aeq_6 = AssertEqual(
    Name="create-text-body\html\request-body-to-string",
    Actual=panel_8,
    Expected="REQUEST BODY [ text/html ]",
    Tolerance=1e-06)
aeq_7 = AssertEqual(
    Name="create-text-body\xml\request-body-to-string",
    Actual=panel_9,
    Expected="REQUEST BODY [ application/xml ]",
    Tolerance=1e-06)
aeq_8 = AssertEqual(
    Name="create-text-body-custom\csv\request-body-to-string",
    Actual=panel_10,
    Expected="REQUEST BODY [ text/csv ]",
    Tolerance=1e-06)
aeq_9 = AssertEqual(
    Name="create-byte-array-body\csv\request-body-to-string",
    Actual=panel_11,
    Expected="REQUEST BODY [ text/csv ]",
    Tolerance=1e-06)
pjs = ParseJSONString(Text=panel_3)
pjs_2 = ParseJSONString(Text=panel_4)
pjs_3 = ParseJSONString(Text=panel_4)
pjs_4 = ParseJSONString(Text=panel_3)
test_result_to_json_3 = TestResultToJSON(Result=aeq)
test_result_to_json_4 = TestResultToJSON(Result=aeq_2)
pjs_5 = ParseJSONString(Text=panel_4)
pjs_6 = ParseJSONString(Text=panel_3)
pjs_7 = ParseJSONString(Text=panel_3)
pjs_8 = ParseJSONString(Text=panel_4)
db = DeconstructBody(Body=cfueb)  # -> ContentType, Text, Bytes
test_result_to_json_5 = TestResultToJSON(Result=annl_3)
test_result_to_json_6 = TestResultToJSON(Result=annl_4)
dhh = DeconstructHttpHeader(Header=ch)  # -> Key, Value
babff = CreateByteArrayBodyFromFile(Path=py3, ContentType="image/png")
test_result_to_json_7 = TestResultToJSON(Result=aeq_3)
test_result_to_json_8 = TestResultToJSON(Result=aeq_4)
test_result_to_json_9 = TestResultToJSON(Result=aeq_5)
test_result_to_json_10 = TestResultToJSON(Result=aeq_6)
test_result_to_json_11 = TestResultToJSON(Result=aeq_7)
test_result_to_json_12 = TestResultToJSON(Result=aeq_8)
test_result_to_json_13 = TestResultToJSON(Result=aeq_9)
dqp = DeconstructQueryParam(Param=cqp)  # -> Key, Value
merge = Merge(Data1=cmft, Data2=cmfby)
context_print_3 = ContextPrint(CreateUrlUrlNoLeadingSlash=test_result_to_json_3)
context_print_4 = ContextPrint(CreateUrlUrlNoLeadingSlash=test_result_to_json_4)
context_print_5 = ContextPrint(CreateMultipartFieldTextRequestBodyIsNotNull=test_result_to_json_6)
context_print_6 = ContextPrint(CreateMultipartFieldBytesRequestBodyIsNotNull=test_result_to_json_5)
panel_15 = Panel(dhh.Key)
panel_16 = Panel(dhh.Value)
panel_17 = Panel(db.ContentType)
panel_18 = Panel(db.Text)
panel_19 = Panel(dqp.Key)
panel_20 = Panel(dqp.Value)
mjo = MergeJSONObjects(JSONObjectA=pjs_2, JSONObjectB=pjs, Mode="0")
mjo_2 = MergeJSONObjects(JSONObjectA=pjs_8, JSONObjectB=pjs_6, Mode="3")
mjo_3 = MergeJSONObjects(JSONObjectA=pjs_5, JSONObjectB=pjs_7, Mode="1")
mjo_4 = MergeJSONObjects(JSONObjectA=pjs_3, JSONObjectB=pjs_4, Mode="2")
db_2 = DeconstructBody(Body=ctb)  # -> ContentType, Text, Bytes
context_print_7 = ContextPrint(CreateTextBodyJsonRequestBodyToString=test_result_to_json_7)
db_3 = DeconstructBody(Body=ctb_2)  # -> ContentType, Text, Bytes
context_print_8 = ContextPrint(CreateTextBodyTextRequestBodyToString=test_result_to_json_8)
db_4 = DeconstructBody(Body=ctb_3)  # -> ContentType, Text, Bytes
context_print_9 = ContextPrint(CreateTextBodyJavascriptRequestBodyToString=test_result_to_json_9)
db_5 = DeconstructBody(Body=ctb_4)  # -> ContentType, Text, Bytes
context_print_10 = ContextPrint(CreateTextBodyHtmlRequestBodyToString=test_result_to_json_10)
db_6 = DeconstructBody(Body=ctb_5)  # -> ContentType, Text, Bytes
context_print_11 = ContextPrint(CreateTextBodyXmlRequestBodyToString=test_result_to_json_11)
db_7 = DeconstructBody(Body=ctbc)  # -> ContentType, Text, Bytes
context_print_12 = ContextPrint(CreateTextBodyCustomCsvRequestBodyToString=test_result_to_json_12)
db_8 = DeconstructBody(Body=cbab)  # -> ContentType, Text, Bytes
context_print_13 = ContextPrint(CreateByteArrayBodyCsvRequestBodyToString=test_result_to_json_13)
db_9 = DeconstructBody(Body=babff)  # -> ContentType, Text, Bytes
sjt = StringifyJSONToken(JToken=mjo)
annl_5 = AssertNotNull(Name="create-byte-array-body-from-file\body-is-not-null", Value=babff)
sjt_2 = StringifyJSONToken(JToken=mjo_2)
sjt_3 = StringifyJSONToken(JToken=mjo_3)
sjt_4 = StringifyJSONToken(JToken=mjo_4)
cmfb = CreateMultipartFormBody(Fields=merge)
durl = DeconstructURL(URL=concat)  # -> Base, Scheme, Host, Route, Params
test_result_to_json_14 = TestResultToJSON(Result=annl_5)
panel_21 = Panel(durl.Base)
aeq_10 = AssertEqual(
    Name="create-byte-array-body-from-file\content-type-matches",
    Actual=db_9.ContentType,
    Expected="image/png",
    Tolerance=1e-06)
dmb = DeconstructMultipartBody(Body=cmfb)
mode_0 = Panel(sjt)
mode_1 = Panel(sjt_3)
mode_2 = Panel(sjt_4)
mode_3 = Panel(sjt_2)
context_print_14 = ContextPrint(CreateByteArrayBodyFromFileBodyIsNotNull=test_result_to_json_14)
aeq_11 = AssertEqual(Name="create-http-header\header-value-matches", Actual=panel_16, Expected="some-value", Tolerance=1e-06)
aeq_12 = AssertEqual(Name="create-http-header\header-key-matches", Actual=panel_15, Expected="some-key", Tolerance=1e-06)
aeq_13 = AssertEqual(Name="create-query-param\param-value-matches", Actual=panel_20, Expected="some-value", Tolerance=1e-06)
aeq_14 = AssertEqual(Name="create-query-param\param-key-matches", Actual=panel_19, Expected="some-key", Tolerance=1e-06)
test_result_to_json_15 = TestResultToJSON(Result=aeq_10)
aeq_15 = AssertEqual(
    Name="create-form-url-encoded-body\value-matches",
    Actual=panel_18,
    Expected="client_id=swiftlet&grant_type=authorization_code",
    Tolerance=1e-06)
aeq_16 = AssertEqual(
    Name="create-form-url-encoded-body\content-type-matches",
    Actual=panel_17,
    Expected="application/x-www-form-urlencoded",
    Tolerance=1e-06)
panel_22 = Panel("""{
  "hello" : "world"
}""")
panel_23 = Panel(durl.Route)
panel_24 = Panel(db_2.Bytes)
panel_25 = Panel(db_3.Bytes)
panel_26 = Panel(db_4.Bytes)
panel_27 = Panel(db_5.Bytes)
panel_28 = Panel(db_6.Bytes)
panel_29 = Panel(db_7.Bytes)
panel_30 = Panel(db_8.Bytes)
alen = AssertListLength(Name="create-multipart-body\two-fields-in-list", List=dmb, Length="2")
test_result_to_json_16 = TestResultToJSON(Result=aeq_11)
test_result_to_json_17 = TestResultToJSON(Result=aeq_12)
context_print_15 = ContextPrint(CreateByteArrayBodyFromFileContentTypeMatches=test_result_to_json_15)
test_result_to_json_18 = TestResultToJSON(Result=aeq_13)
test_result_to_json_19 = TestResultToJSON(Result=aeq_14)
panel_31 = Panel(durl.Scheme)
panel_32 = Panel(durl.Host)
test_result_to_json_20 = TestResultToJSON(Result=aeq_15)
item = ListItem(List=dmb, Index=0, Wrap=True)  # -> Item, Item1
test_result_to_json_21 = TestResultToJSON(Result=aeq_16)
test_result_to_json_22 = TestResultToJSON(Result=alen)
context_print_16 = ContextPrint(CreateHttpHeaderHeaderValueMatches=test_result_to_json_16)
context_print_17 = ContextPrint(CreateQueryParamParamValueMatches=test_result_to_json_18)
context_print_18 = ContextPrint(CreateHttpHeaderHeaderKeyMatches=test_result_to_json_17)
context_print_19 = ContextPrint(CreateQueryParamParamKeyMatches=test_result_to_json_19)
context_print_20 = ContextPrint(CreateFormUrlEncodedBodyContentTypeMatches=test_result_to_json_21)
item_2 = ListItem(List=durl.Params, Index=0, Wrap=True)  # -> Item, Item1
aeq_17 = AssertEqual(Name="deconstruct-url\base-url", Actual=panel_21, Expected="http://localhost:5000/example/route", Tolerance=1e-06)
alen_2 = AssertListLength(Name="deconstruct-url\params-list-length", List=durl.Params, Length="2")
aeq_18 = AssertEqual(Name="deconstruct-url\scheme", Actual=panel_31, Expected="http", Tolerance=1e-06)
aeq_19 = AssertEqual(Name="deconstruct-url\localhost", Actual=panel_32, Expected="localhost", Tolerance=1e-06)
aeq_20 = AssertEqual(Name="deconstruct-url\route", Actual=panel_23, Expected="/example/route", Tolerance=1e-06)
context_print_21 = ContextPrint(CreateFormUrlEncodedBodyValueMatches=test_result_to_json_20)
aeq_21 = AssertEqual(Name="create-text-body\json\content-type", Actual=db_2.ContentType, Expected="application/json", Tolerance=1e-06)
aeq_22 = AssertEqual(Name="create-text-body\json\text", Actual=db_2.Text, Expected=panel_22, Tolerance=1e-06)
aeq_23 = AssertEqual(Name="create-text-body\json\byte-array", Actual=panel_24, Expected="BYTE ARRAY [ 25 ]", Tolerance=1e-06)
aeq_24 = AssertEqual(Name="create-text-body\text\content-type", Actual=db_3.ContentType, Expected="text/plain", Tolerance=1e-06)
aeq_25 = AssertEqual(Name="create-text-body\text\text", Actual=db_3.Text, Expected="Hello World", Tolerance=1e-06)
aeq_26 = AssertEqual(Name="create-text-body\text\byte-array", Actual=panel_25, Expected="BYTE ARRAY [ 11 ]", Tolerance=1e-06)
aeq_27 = AssertEqual(Name="create-text-body\javascript\content-type", Actual=db_4.ContentType, Expected="text/javascript", Tolerance=1e-06)
aeq_28 = AssertEqual(Name="create-text-body\javascript\text", Actual=db_4.Text, Expected="console.log(\"Hello World\");", Tolerance=1e-06)
aeq_29 = AssertEqual(Name="create-text-body\javascript\byte-array", Actual=panel_26, Expected="BYTE ARRAY [ 27 ]", Tolerance=1e-06)
aeq_30 = AssertEqual(Name="create-text-body\javascript\content-type", Actual=db_5.ContentType, Expected="text/javascript", Tolerance=1e-06)
aeq_31 = AssertEqual(Name="create-text-body\javascript\text", Actual=db_5.Text, Expected="console.log(\"Hello World\");", Tolerance=1e-06)
aeq_32 = AssertEqual(Name="create-text-body\javascript\byte-array", Actual=panel_27, Expected="BYTE ARRAY [ 27 ]", Tolerance=1e-06)
aeq_33 = AssertEqual(Name="create-text-body\javascript\content-type", Actual=db_6.ContentType, Expected="text/javascript", Tolerance=1e-06)
aeq_34 = AssertEqual(Name="create-text-body\javascript\text", Actual=db_6.Text, Expected="console.log(\"Hello World\");", Tolerance=1e-06)
aeq_35 = AssertEqual(Name="create-text-body\javascript\byte-array", Actual=panel_28, Expected="BYTE ARRAY [ 27 ]", Tolerance=1e-06)
aeq_36 = AssertEqual(Name="create-text-body\csv\content-type", Actual=db_7.ContentType, Expected="text/csv", Tolerance=1e-06)
aeq_37 = AssertEqual(Name="create-text-body\csv\text", Actual=db_7.Text, Expected="1,2,3,4,5", Tolerance=1e-06)
aeq_38 = AssertEqual(Name="create-text-body\csv\byte-array", Actual=panel_29, Expected="BYTE ARRAY [ 9 ]", Tolerance=1e-06)
aeq_39 = AssertEqual(Name="create-byte-array-body\csv\content-type", Actual=db_8.ContentType, Expected="text/csv", Tolerance=1e-06)
aeq_40 = AssertEqual(Name="create-byte-array-body\csv\text", Actual=db_8.Text, Expected="1,2,3,4,5", Tolerance=1e-06)
aeq_41 = AssertEqual(Name="create-byte-array-body\csv\byte-array", Actual=panel_30, Expected="BYTE ARRAY [ 9 ]", Tolerance=1e-06)
context_print_22 = ContextPrint(CreateMultipartBodyTwoFieldsInList=test_result_to_json_22)
dmf = DeconstructMultipartField(Field=item.Item)  # -> Name, Text, Bytes, FileName, ContentType
dmf_2 = DeconstructMultipartField(Field=item.Item1)  # -> Name, Text, Bytes, FileName, ContentType
test_result_to_json_23 = TestResultToJSON(Result=aeq_17)
test_result_to_json_24 = TestResultToJSON(Result=aeq_18)
test_result_to_json_25 = TestResultToJSON(Result=aeq_19)
mode_0_2 = Panel("""{
  "callsign": "SWR142",
  "heading": 274,
  "altitude": 11200,
  "fuel": {
    "remainingKg": 3820,
    "flowKgPerHour": 1480,
    "tankBalanceOk": true
  },
  "position": {
    "lat": 47.451,
    "lon": 8.564,
    "waypoint": "LUGUS",
    "runway": "14"
  },
  "autopilot": {
    "engaged": true,
    "mode": "LNAV"
  },
  "squawk": "4712",
  "destination": "LSZH",
  "alerts": [
    "crosswind",
    "light_turbulence"
  ],
  "etaMinutes": 18,
  "remarks": null,
  "origin": "LEBL"
}""")
mode_1_2 = Panel("""{
  "callsign": "SWR142",
  "heading": 276,
  "altitude": null,
  "fuel": {
    "remainingKg": 3610,
    "flowKgPerHour": 1515,
    "tankBalanceOk": null
  },
  "position": {
    "lat": 47.462,
    "lon": 8.548,
    "waypoint": "LUGUS",
    "runway": "14"
  },
  "autopilot": {
    "engaged": true,
    "mode": "APP"
  },
  "squawk": "4712",
  "destination": "LSZH",
  "alerts": [
    "glideslope_capture"
  ],
  "etaMinutes": 16,
  "remarks": "High approach due traffic",
  "origin": "LEBL"
}""")
mode_2_2 = Panel("""{
  "callsign": "SWR142",
  "heading": 274,
  "altitude": 11200,
  "fuel": {
    "remainingKg": 3820,
    "flowKgPerHour": 1480,
    "tankBalanceOk": true
  },
  "position": {
    "lat": 47.451,
    "lon": 8.564,
    "waypoint": "LUGUS",
    "runway": "14"
  },
  "autopilot": {
    "engaged": true,
    "mode": "LNAV"
  },
  "squawk": "4712",
  "destination": "LSZH",
  "alerts": [
    "crosswind",
    "light_turbulence"
  ],
  "etaMinutes": 18,
  "remarks": "High approach due traffic",
  "origin": "LEBL"
}""")
test_result_to_json_26 = TestResultToJSON(Result=aeq_20)
mode_3_2 = Panel("""{
  "callsign": "SWR142",
  "heading": 276,
  "altitude": 11200,
  "fuel": {
    "remainingKg": 3610,
    "flowKgPerHour": 1515,
    "tankBalanceOk": true
  },
  "position": {
    "lat": 47.462,
    "lon": 8.548,
    "waypoint": "LUGUS",
    "runway": "14"
  },
  "autopilot": {
    "engaged": true,
    "mode": "APP"
  },
  "squawk": "4712",
  "destination": "LSZH",
  "alerts": [
    "glideslope_capture"
  ],
  "etaMinutes": 16,
  "remarks": "High approach due traffic",
  "origin": "LEBL"
}""")
test_result_to_json_27 = TestResultToJSON(Result=alen_2)
annl_6 = AssertNotNull(Name="deconstruct-url\params\first-param-not-null", Value=item_2.Item)
annl_7 = AssertNotNull(Name="deconstruct-url\params\second-param-not-null", Value=item_2.Item1)
test_result_to_json_28 = TestResultToJSON(Result=aeq_21)
test_result_to_json_29 = TestResultToJSON(Result=aeq_22)
test_result_to_json_30 = TestResultToJSON(Result=aeq_23)
test_result_to_json_31 = TestResultToJSON(Result=aeq_24)
test_result_to_json_32 = TestResultToJSON(Result=aeq_25)
test_result_to_json_33 = TestResultToJSON(Result=aeq_26)
test_result_to_json_34 = TestResultToJSON(Result=aeq_27)
test_result_to_json_35 = TestResultToJSON(Result=aeq_28)
test_result_to_json_36 = TestResultToJSON(Result=aeq_29)
test_result_to_json_37 = TestResultToJSON(Result=aeq_30)
test_result_to_json_38 = TestResultToJSON(Result=aeq_31)
test_result_to_json_39 = TestResultToJSON(Result=aeq_32)
test_result_to_json_40 = TestResultToJSON(Result=aeq_33)
test_result_to_json_41 = TestResultToJSON(Result=aeq_34)
test_result_to_json_42 = TestResultToJSON(Result=aeq_35)
test_result_to_json_43 = TestResultToJSON(Result=aeq_36)
test_result_to_json_44 = TestResultToJSON(Result=aeq_37)
test_result_to_json_45 = TestResultToJSON(Result=aeq_38)
test_result_to_json_46 = TestResultToJSON(Result=aeq_39)
test_result_to_json_47 = TestResultToJSON(Result=aeq_40)
test_result_to_json_48 = TestResultToJSON(Result=aeq_41)
panel_33 = Panel(dmf_2.Bytes)
panel_34 = Panel("""{
  "hello" : "world"
}""")
context_print_23 = ContextPrint(DeconstructUrlBaseUrl=test_result_to_json_23)
context_print_24 = ContextPrint(DeconstructUrlScheme=test_result_to_json_24)
context_print_25 = ContextPrint(DeconstructUrlLocalhost=test_result_to_json_25)
context_print_26 = ContextPrint(DeconstructUrlRoute=test_result_to_json_26)
context_print_27 = ContextPrint(DeconstructUrlParamsListLength=test_result_to_json_27)
context_print_28 = ContextPrint(CreateTextBodyJsonContentType=test_result_to_json_28)
context_print_29 = ContextPrint(CreateTextBodyJsonText=test_result_to_json_29)
context_print_30 = ContextPrint(CreateTextBodyJsonByteArray=test_result_to_json_30)
context_print_31 = ContextPrint(CreateTextBodyJsonContentType=test_result_to_json_31)
context_print_32 = ContextPrint(CreateTextBodyJsonText=test_result_to_json_32)
context_print_33 = ContextPrint(CreateTextBodyJsonByteArray=test_result_to_json_33)
context_print_34 = ContextPrint(CreateTextBodyJavascriptContentType=test_result_to_json_34)
context_print_35 = ContextPrint(CreateTextBodyJavascriptText=test_result_to_json_35)
context_print_36 = ContextPrint(CreateTextBodyJavascriptByteArray=test_result_to_json_36)
context_print_37 = ContextPrint(CreateTextBodyJavascriptContentType=test_result_to_json_37)
context_print_38 = ContextPrint(CreateTextBodyJavascriptText=test_result_to_json_38)
context_print_39 = ContextPrint(CreateTextBodyJavascriptByteArray=test_result_to_json_39)
context_print_40 = ContextPrint(CreateTextBodyJavascriptContentType=test_result_to_json_40)
context_print_41 = ContextPrint(CreateTextBodyJavascriptText=test_result_to_json_41)
context_print_42 = ContextPrint(CreateTextBodyJavascriptByteArray=test_result_to_json_42)
context_print_43 = ContextPrint(CreateTextBodyCsvContentType=test_result_to_json_43)
context_print_44 = ContextPrint(CreateTextBodyCsvText=test_result_to_json_44)
context_print_45 = ContextPrint(CreateTextBodyCsvByteArray=test_result_to_json_45)
context_print_46 = ContextPrint(CreateByteArrayBodyCsvContentType=test_result_to_json_46)
context_print_47 = ContextPrint(CreateByteArrayBodyCsvText=test_result_to_json_47)
context_print_48 = ContextPrint(CreateByteArrayBodyCsvByteArray=test_result_to_json_48)
test_result_to_json_49 = TestResultToJSON(Result=annl_6)
test_result_to_json_50 = TestResultToJSON(Result=annl_7)
context_print_49 = ContextPrint(DeconstructUrlParamsSecondParamNotNull=test_result_to_json_50)
context_print_50 = ContextPrint(DeconstructUrlParamsFirstParamNotNull=test_result_to_json_49)
aeq_42 = AssertEqual(Name="deconstruct-multipart-field-2\name-matches", Actual=dmf_2.Name, Expected="my-file", Tolerance=1e-06)
aeq_43 = AssertEqual(Name="deconstruct-multipart-field-2\value-matches", Actual=panel_33, Expected="BYTE ARRAY [ 4 ]", Tolerance=1e-06)
aeq_44 = AssertEqual(Name="deconstruct-multipart-field-1\value-matches", Actual=dmf.Text, Expected=panel_34, Tolerance=1e-06)
aeq_45 = AssertEqual(Name="deconstruct-multipart-field-1\name-matches", Actual=dmf.Name, Expected="hello-world", Tolerance=1e-06)
test_result_to_json_51 = TestResultToJSON(Result=aeq_42)
test_result_to_json_52 = TestResultToJSON(Result=aeq_43)
test_result_to_json_53 = TestResultToJSON(Result=aeq_44)
test_result_to_json_54 = TestResultToJSON(Result=aeq_45)
context_print_51 = ContextPrint(DeconstructMultipartField1NameMatches=test_result_to_json_54)
context_print_52 = ContextPrint(DeconstructMultipartField2NameMatches=test_result_to_json_51)
context_print_53 = ContextPrint(DeconstructMultipartField1ValueMatches=test_result_to_json_53)
context_print_54 = ContextPrint(DeconstructMultipartField2ValueMatches=test_result_to_json_52)
aeq_46 = AssertEqual(Name="merge-json-objects\mode-0-output-matches", Actual=mode_0, Expected=mode_0_2, Tolerance=1e-06)
aeq_47 = AssertEqual(Name="merge-json-objects\mode-1-output-matches", Actual=mode_1, Expected=mode_1_2, Tolerance=1e-06)
aeq_48 = AssertEqual(Name="merge-json-objects\mode-2-output-matches", Actual=mode_2, Expected=mode_2_2, Tolerance=1e-06)
aeq_49 = AssertEqual(Name="merge-json-objects\mode-3-output-matches", Actual=mode_3, Expected=mode_3_2, Tolerance=1e-06)
test_result_to_json_55 = TestResultToJSON(Result=aeq_46)
test_result_to_json_56 = TestResultToJSON(Result=aeq_47)
test_result_to_json_57 = TestResultToJSON(Result=aeq_48)
test_result_to_json_58 = TestResultToJSON(Result=aeq_49)
context_print_55 = ContextPrint(MergeJsonObjectsMode0OutputMatches=test_result_to_json_55)
context_print_56 = ContextPrint(MergeJsonObjectsMode1OutputMatches=test_result_to_json_56)
context_print_57 = ContextPrint(MergeJsonObjectsMode2OutputMatches=test_result_to_json_57)
context_print_58 = ContextPrint(MergeJsonObjectsMode3OutputMatches=test_result_to_json_58)
