# Grasshopper definition send.gh (Grasshopper 1.0.8)
# plug-ins: Assertive Possum, Swiftlet

ch = CreateHttpHeader(Key="test", Value="assertive-possum")
cqp = CreateQueryParam(Key="test", Value="assertive-possum")
ch_2 = CreateHttpHeader(Key="test", Value="assertive-possum")
cqp_2 = CreateQueryParam(Key="test", Value="assertive-possum")
ctb = CreateTextBody(
    Content="{\"hello\": \"world\"}",
    IsHtmlChecked=False,
    IsJavascriptChecked=False,
    IsJsonChecked=True,
    IsTextChecked=False,
    IsXmlChecked=False)
ch_3 = CreateHttpHeader(Key="test", Value="assertive-possum")
cqp_3 = CreateQueryParam(Key="test", Value="assertive-possum")
ctb_2 = CreateTextBody(
    Content="{\"hello\": \"world\"}",
    IsHtmlChecked=False,
    IsJavascriptChecked=False,
    IsJsonChecked=True,
    IsTextChecked=False,
    IsXmlChecked=False)
get = GETRequest(URL="http://httpbin.org/get", Params=cqp, Headers=ch, TimeoutSeconds=100)  # -> Status, Content, Response
post = POSTRequest(URL="http://httpbin.org/post", Body=ctb, Params=cqp_2, Headers=ch_2, TimeoutSeconds=100)  # -> Status, Content, Response
ch_4 = CreateHttpHeader(Key="test", Value="assertive-possum")
cqp_4 = CreateQueryParam(Key="test", Value="assertive-possum")
ch_5 = CreateHttpHeader(Key="test", Value="assertive-possum")
cqp_5 = CreateQueryParam(Key="test", Value="assertive-possum")
ctb_3 = CreateTextBody(
    Content="{\"hello\": \"world\"}",
    IsHtmlChecked=False,
    IsJavascriptChecked=False,
    IsJsonChecked=True,
    IsTextChecked=False,
    IsXmlChecked=False)
put = PUTRequest(URL="http://httpbin.org/put", Body=ctb_2, Params=cqp_3, Headers=ch_3, TimeoutSeconds=100)  # -> Status, Content, Response
req = HTTPRequest(URL="http://httpbin.org/get", Method="HEAD", TimeoutSeconds=100)  # -> Status, Content, Response
delete = DELETERequest(URL="http://httpbin.org/delete", Params=cqp_4, Headers=ch_4, TimeoutSeconds=100)  # -> Status, Content, Response
patch = PATCHRequest(URL="http://httpbin.org/patch", Body=ctb_3, Params=cqp_5, Headers=ch_5, TimeoutSeconds=100)  # -> Status, Content, Response
pjs = ParseJSONString(Text=get.Content)
aeq = AssertEqual(Name="get-request\code-200", Actual=get.Status, Expected=Slider(200, range=0..1000), Tolerance=1e-06)
pjs_2 = ParseJSONString(Text=put.Content)
pjs_3 = ParseJSONString(Text=post.Content)
dr = DeconstructResponse(Response=req.Response)  # -> Version, Status, Reason, Headers, IsSuccess, Content, ByteArray
gjok = GetJSONObjectKey(JObject=pjs, Key="args")
gjok_2 = GetJSONObjectKey(JObject=pjs, Key="headers")
test_result_to_json = TestResultToJSON(Result=aeq)
pjs_4 = ParseJSONString(Text=patch.Content)
aeq_2 = AssertEqual(Name="post-request\code-200", Actual=post.Status, Expected=Slider(200, range=0..1000), Tolerance=1e-06)
gjok_3 = GetJSONObjectKey(JObject=pjs_2, Key="args")
gjok_4 = GetJSONObjectKey(JObject=pjs_3, Key="args")
gjok_5 = GetJSONObjectKey(JObject=pjs_2, Key="headers")
gjok_6 = GetJSONObjectKey(JObject=pjs_2, Key="json")
gjok_7 = GetJSONObjectKey(JObject=gjok, Key="test")
gjok_8 = GetJSONObjectKey(JObject=pjs_3, Key="headers")
gjok_9 = GetJSONObjectKey(JObject=pjs_3, Key="json")
gjok_10 = GetJSONObjectKey(JObject=gjok_2, Key="Test")
lng = ListLength(List=dr.Headers)
aeq_3 = AssertEqual(Name="put-request\code-200", Actual=put.Status, Expected=Slider(200, range=0..1000), Tolerance=1e-06)
pjs_5 = ParseJSONString(Text=delete.Content)
context_print = ContextPrint(GetRequestCode200=test_result_to_json)
gjok_11 = GetJSONObjectKey(JObject=pjs_4, Key="args")
gjok_12 = GetJSONObjectKey(JObject=pjs_4, Key="headers")
gjok_13 = GetJSONObjectKey(JObject=pjs_4, Key="json")
gjok_14 = GetJSONObjectKey(JObject=gjok_3, Key="test")
gjok_15 = GetJSONObjectKey(JObject=gjok_4, Key="test")
gjok_16 = GetJSONObjectKey(JObject=gjok_5, Key="Test")
gjok_17 = GetJSONObjectKey(JObject=gjok_8, Key="Test")
test_result_to_json_2 = TestResultToJSON(Result=aeq_2)
rjv = ReadJSONValue(JValue=gjok_7)  # -> AsString, AsNumber, AsBool
aeq_4 = AssertEqual(Name="patch-request\code-200", Actual=patch.Status, Expected=Slider(200, range=0..1000), Tolerance=1e-06)
rjv_2 = ReadJSONValue(JValue=gjok_10)  # -> AsString, AsNumber, AsBool
gjok_18 = GetJSONObjectKey(JObject=gjok_6, Key="hello")
aeq_5 = AssertEqual(Name="head-request\code-200", Actual=req.Status, Expected=Slider(200, range=0..1000), Tolerance=1e-06)
gjok_19 = GetJSONObjectKey(JObject=gjok_9, Key="hello")
larger = LargerThan(FirstNumber=lng, SecondNumber="0")  # -> LargerThan, OrEqualTo
gjok_20 = GetJSONObjectKey(JObject=pjs_5, Key="args")
gjok_21 = GetJSONObjectKey(JObject=pjs_5, Key="headers")
test_result_to_json_3 = TestResultToJSON(Result=aeq_3)
gjok_22 = GetJSONObjectKey(JObject=gjok_11, Key="test")
gjok_23 = GetJSONObjectKey(JObject=gjok_12, Key="Test")
rjv_3 = ReadJSONValue(JValue=gjok_14)  # -> AsString, AsNumber, AsBool
aeq_6 = AssertEqual(Name="delete-request\code-200", Actual=delete.Status, Expected=Slider(200, range=0..1000), Tolerance=1e-06)
rjv_4 = ReadJSONValue(JValue=gjok_15)  # -> AsString, AsNumber, AsBool
rjv_5 = ReadJSONValue(JValue=gjok_16)  # -> AsString, AsNumber, AsBool
context_print_2 = ContextPrint(PostRequestCode200=test_result_to_json_2)
rjv_6 = ReadJSONValue(JValue=gjok_17)  # -> AsString, AsNumber, AsBool
gjok_24 = GetJSONObjectKey(JObject=gjok_13, Key="hello")
test_result_to_json_4 = TestResultToJSON(Result=aeq_4)
gjok_25 = GetJSONObjectKey(JObject=gjok_20, Key="test")
gjok_26 = GetJSONObjectKey(JObject=gjok_21, Key="Test")
test_result_to_json_5 = TestResultToJSON(Result=aeq_5)
rjv_7 = ReadJSONValue(JValue=gjok_18)  # -> AsString, AsNumber, AsBool
rjv_8 = ReadJSONValue(JValue=gjok_19)  # -> AsString, AsNumber, AsBool
context_print_3 = ContextPrint(PutRequestCode200=test_result_to_json_3)
rjv_9 = ReadJSONValue(JValue=gjok_22)  # -> AsString, AsNumber, AsBool
rjv_10 = ReadJSONValue(JValue=gjok_23)  # -> AsString, AsNumber, AsBool
atru = AssertTrue(Name="deconstruct-response\headers", Value=larger.LargerThan)
atru_2 = AssertTrue(Name="deconstruct-response\success", Value=dr.IsSuccess)
test_result_to_json_6 = TestResultToJSON(Result=aeq_6)
context_print_4 = ContextPrint(PatchRequestCode200=test_result_to_json_4)
rjv_11 = ReadJSONValue(JValue=gjok_24)  # -> AsString, AsNumber, AsBool
rjv_12 = ReadJSONValue(JValue=gjok_25)  # -> AsString, AsNumber, AsBool
aeq_7 = AssertEqual(Name="get-request\has-query-param", Actual=rjv.AsString, Expected="assertive-possum", Tolerance=1e-06)
rjv_13 = ReadJSONValue(JValue=gjok_26)  # -> AsString, AsNumber, AsBool
aeq_8 = AssertEqual(Name="get-request\has-header", Actual=rjv_2.AsString, Expected="assertive-possum", Tolerance=1e-06)
context_print_5 = ContextPrint(HeadRequestCode200=test_result_to_json_5)
test_result_to_json_7 = TestResultToJSON(Result=atru)
test_result_to_json_8 = TestResultToJSON(Result=atru_2)
context_print_6 = ContextPrint(DeleteRequestCode200=test_result_to_json_6)
aeq_9 = AssertEqual(Name="put-request\has-query-param", Actual=rjv_3.AsString, Expected="assertive-possum", Tolerance=1e-06)
aeq_10 = AssertEqual(Name="post-request\has-query-param", Actual=rjv_4.AsString, Expected="assertive-possum", Tolerance=1e-06)
aeq_11 = AssertEqual(Name="put-request\has-header", Actual=rjv_5.AsString, Expected="assertive-possum", Tolerance=1e-06)
aeq_12 = AssertEqual(Name="post-request\has-header", Actual=rjv_6.AsString, Expected="assertive-possum", Tolerance=1e-06)
test_result_to_json_9 = TestResultToJSON(Result=aeq_7)
test_result_to_json_10 = TestResultToJSON(Result=aeq_8)
aeq_13 = AssertEqual(Name="put-request\json-payload-value-matches", Actual=rjv_7.AsString, Expected="world", Tolerance=1e-06)
aeq_14 = AssertEqual(Name="post-request\json-payload-value-matches", Actual=rjv_8.AsString, Expected="world", Tolerance=1e-06)
aeq_15 = AssertEqual(Name="patch-request\has-query-param", Actual=rjv_9.AsString, Expected="assertive-possum", Tolerance=1e-06)
aeq_16 = AssertEqual(Name="patch-request\has-header", Actual=rjv_10.AsString, Expected="assertive-possum", Tolerance=1e-06)
context_print_7 = ContextPrint(DeconstructResponseHeaders=test_result_to_json_7)
context_print_8 = ContextPrint(DeconstructResponseSuccess=test_result_to_json_8)
test_result_to_json_11 = TestResultToJSON(Result=aeq_9)
test_result_to_json_12 = TestResultToJSON(Result=aeq_10)
test_result_to_json_13 = TestResultToJSON(Result=aeq_11)
test_result_to_json_14 = TestResultToJSON(Result=aeq_12)
aeq_17 = AssertEqual(Name="patch-request\json-payload-value-matches", Actual=rjv_11.AsString, Expected="world", Tolerance=1e-06)
context_print_9 = ContextPrint(GetRequestHasQueryParam=test_result_to_json_9)
aeq_18 = AssertEqual(Name="delete-request\has-query-param", Actual=rjv_12.AsString, Expected="assertive-possum", Tolerance=1e-06)
aeq_19 = AssertEqual(Name="delete-request\has-header", Actual=rjv_13.AsString, Expected="assertive-possum", Tolerance=1e-06)
context_print_10 = ContextPrint(GetRequestHasHeader=test_result_to_json_10)
test_result_to_json_15 = TestResultToJSON(Result=aeq_13)
test_result_to_json_16 = TestResultToJSON(Result=aeq_14)
test_result_to_json_17 = TestResultToJSON(Result=aeq_15)
test_result_to_json_18 = TestResultToJSON(Result=aeq_16)
context_print_11 = ContextPrint(PutRequestHasQueryParam=test_result_to_json_11)
context_print_12 = ContextPrint(PostRequestHasQueryParam=test_result_to_json_12)
context_print_13 = ContextPrint(PutRequestHasHeader=test_result_to_json_13)
test_result_to_json_19 = TestResultToJSON(Result=aeq_17)
context_print_14 = ContextPrint(PostRequestHasHeader=test_result_to_json_14)
test_result_to_json_20 = TestResultToJSON(Result=aeq_18)
test_result_to_json_21 = TestResultToJSON(Result=aeq_19)
context_print_15 = ContextPrint(PatchRequestHasQueryParam=test_result_to_json_17)
context_print_16 = ContextPrint(PutRequestJsonPayloadValueMatches=test_result_to_json_15)
context_print_17 = ContextPrint(PostRequestJsonPayloadValueMatches=test_result_to_json_16)
context_print_18 = ContextPrint(PatchRequestHasHeader=test_result_to_json_18)
context_print_19 = ContextPrint(DeleteRequestHasQueryParam=test_result_to_json_20)
context_print_20 = ContextPrint(PatchRequestJsonPayloadValueMatches=test_result_to_json_19)
context_print_21 = ContextPrint(DeleteRequestHasHeader=test_result_to_json_21)
