# Grasshopper definition utilities.gh (Grasshopper 1.0.8)
# plug-ins: RhinoCodePluginGH, Assertive Possum, Swiftlet

# ---- group: SET ME TO YOUR LOCAL PATH!!!
merge = Merge(Data1="C:\Users\spigach\Desktop\", Data2="/mnt/c/Users/spigach/Desktop/")

# ----
item = ListItem(List=merge, Index=Slider(1, range=0..1), Wrap=True)
panel = Panel("""So, we'll go no more a roving
   So late into the night,
Though the heart be still as loving,
   And the moon be still as bright.

For the sword outwears its sheath,
   And the soul wears out the breast,
And the heart must pause to breathe,
   And love itself have rest.

Though the night was made for loving,
   And the day returns too soon,
Yet we'll go no more a roving
   By the light of the moon.""")

# ---- group: Desktop
txt = Text(item)

# ----
gguid = GenerateGUID(Generate=True, Format="D")
panel_2 = Panel(gguid)
concat = Concatenate(FragmentA=txt, FragmentB="temp.png")
panel_3 = Panel(concat)
tb64 = TextToBase64(Text=panel, Encoding="UTF8")
qr = GenerateQRCode(Text="Hello from Swiftlet!", Pixels=20, Dark=RGB(0, 0, 0), Light=RGB(255, 255, 255), Quiet=True)
py3 = Python3Script(guid_string=panel_2)  # -> is_valid; inputs guid_string: String
# ---------- py3: Python ----------
import System

try:
    parsed = System.Guid(guid_string)
    is_valid = True
except:
    is_valid = False
# ---------- end py3 ----------
btba = BitmapToByteArray(Bitmap=qr, Format="png")
txtba = TextToByteArray(Text=panel, Encoding="UTF8")
annl = AssertNotNull(Name="generate-qr-code\bitmap-is-not-null", Value=qr)
btm = BitmapToMesh(Bitmap=qr)  # -> Mesh, Colors, Width, Height
b64ba = Base64ToByteArray(Base64=tb64)
annl_2 = AssertNotNull(Name="text-to-base-64\is-not-null", Value=tb64)
panel_4 = Panel("""Jane Doe
123 Main Street,Brooklyn,NY,11111
ID23424""")
bal = ByteArrayToList(ByteArray=txtba)
swatch = ColourSwatch(SwatchColor=RGB(220, 73, 255))
annl_3 = AssertNotNull(Name="text-to-byte-array\is-not-null", Value=txtba)
batxt = ByteArrayToText(ByteArray=b64ba, Encoding="UTF8")
test_result_to_json = TestResultToJSON(Result=annl)
ageo = AssertGeometryValid(Name="bitmap-to-mesh\mesh-is-valid", Geometry=btm.Mesh)
annl_4 = AssertNotNull(Name="base64-to-byte-array\byte-array-is-not-null", Value=b64ba)
bal_2 = ByteArrayToList(ByteArray=b64ba)
atru = AssertTrue(Name="generate-guid\is-valid", Value=py3)
baf = ByteArrayToFile(ByteArray=btba, Path=panel_3)
test_result_to_json_2 = TestResultToJSON(Result=annl_2)
lng = ListLength(List=bal)
bab64 = ByteArrayToBase64(ByteArray=b64ba)
batbmp = ByteArrayToBitmap(ByteArray=btba)
test_result_to_json_3 = TestResultToJSON(Result=annl_3)
context_print = ContextPrint(GenerateQrCodeBitmapIsNotNull=test_result_to_json)
cth = ColorToHex(Color=swatch)
test_result_to_json_4 = TestResultToJSON(Result=atru)
test_result_to_json_5 = TestResultToJSON(Result=annl_4)
test_result_to_json_6 = TestResultToJSON(Result=ageo)
csvl = CreateCSVLine(Cells=panel_4, Delimiter=",")
context_print_2 = ContextPrint(TextToBase64IsNotNull=test_result_to_json_2)
aeq = AssertEqual(Name="byte-array-to-text\text-matches", Actual=batxt, Expected=panel, Tolerance=1e-06)
annl_5 = AssertNotNull(Name="bitmap-to-byte-array\is-not-null", Value=btba)
lba = ListToByteArray(Bytes=bal)
fba = FileToByteArray(Path=panel_3)
htc = HexToColor(Hex=cth)
arng = AssertInRange(Name="byte-array-to-list\list-length-in-range", Value=lng, Min="350", Max="450")
aeq_2 = AssertEqual(Name="byte-array-to-base64\text-matches", Actual=bab64, Expected=tb64, Tolerance=1e-06)
context_print_3 = ContextPrint(GenerateGuidIsValid=test_result_to_json_4)
context_print_4 = ContextPrint(Base64ToByteArrayByteArrayIsNotNull=test_result_to_json_5)
larger = LargerThan(FirstNumber=baf, SecondNumber=Slider(100, range=0..100))  # -> LargerThan, OrEqualTo
context_print_5 = ContextPrint(TextToByteArrayIsNotNull=test_result_to_json_3)
annl_6 = AssertNotNull(Name="byte-array-to-bitmap\is-not-null", Value=batbmp)
panel_5 = Panel(csvl)
context_print_6 = ContextPrint(BitmapToMeshMeshIsValid=test_result_to_json_6)
lng_2 = ListLength(List=bal_2)
bal_3 = ByteArrayToList(ByteArray=fba)
test_result_to_json_7 = TestResultToJSON(Result=aeq)
annl_7 = AssertNotNull(Name="byte-array-to-file\is-not-null", Value=baf)
panel_6 = Panel(lba)
panel_7 = Panel(txtba)
annl_8 = AssertNotNull(Name="color-to-hex\hex-is-not-null", Value=cth)
test_result_to_json_8 = TestResultToJSON(Result=annl_5)
rcsvl = ReadCSVLine(Line=csvl, Delimiter=",")
test_result_to_json_9 = TestResultToJSON(Result=arng)
test_result_to_json_10 = TestResultToJSON(Result=aeq_2)
test_result_to_json_11 = TestResultToJSON(Result=annl_6)
lng_3 = ListLength(List=bal_3)
context_print_7 = ContextPrint(ByteArrayToTextTextMatches=test_result_to_json_7)
concat_2 = Concatenate(FragmentA=txt, FragmentB="temp.csv")
concat_3 = Concatenate(FragmentA=txt, FragmentB="temp.txt")
concat_4 = Concatenate(FragmentA=txt, FragmentB="temp.bin")
test_result_to_json_12 = TestResultToJSON(Result=annl_7)
annl_9 = AssertNotNull(Name="hex-to-color\color-is-not-null", Value=htc)
context_print_8 = ContextPrint(BitmapToByteArrayIsNotNull=test_result_to_json_8)
py3_2 = Python3Script(a_lines=panel_4, b_lines=rcsvl)  # -> all_match; inputs a_lines: list of String, b_lines: list of String
# ---------- py3_2: Python ----------
all_match = True

try:
    for a, b in zip(a_lines, b_lines):
        if a != b:
            all_match = False
except:
    all_match = False
# ---------- end py3_2 ----------
panel_8 = Panel("""John Doe
123 Main St., Brooklyn, NY, 12345
ID12345""")  # disabled
panel_9 = Panel(htc)
panel_10 = Panel("""Jane Doe
234 Main St., Brooklyn, NY, 13456
ID67890""")  # disabled
panel_11 = Panel("""Hiro Protagonist
123 Snowcrash Lane, Brooklyn, NY, 13456
ID11111""")  # disabled
panel_12 = Panel(swatch)
gzip = CompressData(Uncompressed=b64ba)
annl_10 = AssertNotNull(Name="file-to-byte-array\is-not-null", Value=fba)
context_print_9 = ContextPrint(ByteArrayToBase64TextMatches=test_result_to_json_10)
test_result_to_json_13 = TestResultToJSON(Result=annl_8)
panel_13 = Panel(concat_2)
context_print_10 = ContextPrint(ByteArrayToListListLengthInRange=test_result_to_json_9)
panel_14 = Panel(concat_3)
context_print_11 = ContextPrint(ByteArrayToBitmapIsNotNull=test_result_to_json_11)
atru_2 = AssertTrue(Name="byte-array-to-file\written-bytes-above-threshold", Value=larger.LargerThan)
b64t = Base64ToText(Base64=bab64, Encoding="UTF8")
context_print_12 = ContextPrint(ByteArrayToFileIsNotNull=test_result_to_json_12)
aeq_3 = AssertEqual(Name="file-to-byte-array\written-and-read-bytes-match", Actual=lng_3, Expected=baf, Tolerance=1e-06)
annl_11 = AssertNotNull(Name="compress-data\data-is-not-null", Value=gzip)
bal_4 = ByteArrayToList(ByteArray=gzip)
get = GETRequest(URL="https://www.google.com", TimeoutSeconds=100)  # -> Status, Content, Response
test_result_to_json_14 = TestResultToJSON(Result=annl_10)
test_result_to_json_15 = TestResultToJSON(Result=annl_9)
aeq_4 = AssertEqual(Name="list-to-byte-array\tostring-matches", Actual=panel_6, Expected=panel_7, Tolerance=1e-06)
test_result_to_json_16 = TestResultToJSON(Result=atru_2)
dup = DuplicateData(Data=panel_5, Number=Slider(4, range=0..10), Order=True)
test_result_to_json_17 = TestResultToJSON(Result=annl_11)
aeq_5 = AssertEqual(Name="base64-to-text\text-matches", Actual=b64t, Expected=panel, Tolerance=1e-06)
lng_4 = ListLength(List=bal_4)
atru_3 = AssertTrue(Name="read-csv-line\all-lines-match", Value=py3_2)
test_result_to_json_18 = TestResultToJSON(Result=aeq_3)
context_print_13 = ContextPrint(FileToByteArrayIsNotNull=test_result_to_json_14)
context_print_14 = ContextPrint(ColorToHexHexIsNotNull=test_result_to_json_13)
test_result_to_json_19 = TestResultToJSON(Result=aeq_4)
context_print_15 = ContextPrint(HexToColorColorIsNotNull=test_result_to_json_15)
panel_15 = Panel("{0}")  # disabled
panel_16 = Panel("{1}")  # disabled
panel_17 = Panel("{0}")  # disabled
panel_18 = Panel("{0}")  # disabled
py3_3 = Python3Script()  # -> a; disabled
# ---------- py3_3: Python ----------
import Grasshopper as gh

tree = gh.DataTree[object]()
tree.EnsurePath(gh.Kernel.Data.GH_Path(0))

a = tree
# ---------- end py3_3 ----------
panel_19 = Panel("{2}")  # disabled
panel_20 = Panel("{3}")  # disabled
py3_4 = Python3Script()  # -> a; disabled; same code as py3_3
panel_21 = Panel("{0}")  # disabled
panel_22 = Panel("{4}")  # disabled
swr = SaveWebResponse(Response=get.Response, Path=concat_4, binaryChecked=True, textChecked=False)
aeq_6 = AssertEqual(Name="hex-to-color\color-matches", Actual=panel_9, Expected=panel_12, Tolerance=1e-06)
aeq_7 = AssertEqual(
    Name="create-csv-line\output-matches",
    Actual=panel_5,
    Expected="Jane Doe,\"123 Main Street,Brooklyn,NY,11111\",ID23424",
    Tolerance=1e-06)
context_print_16 = ContextPrint(ByteArrayToFileWrittenBytesAboveThreshold=test_result_to_json_16)
smaller = SmallerThan(FirstNumber=lng_4, SecondNumber=lng_2)  # -> SmallerThan, OrEqualTo
test_result_to_json_20 = TestResultToJSON(Result=aeq_5)
context_print_17 = ContextPrint(CompressDataDataIsNotNull=test_result_to_json_17)
context_print_18 = ContextPrint(ListToByteArrayTostringMatches=test_result_to_json_19)
csv = SaveCSV(Lines=dup, Path=panel_13)
st = SaveText(Content=panel_5, Path=panel_14)
stil = SplitTextIntoLines(Text=panel)
test_result_to_json_21 = TestResultToJSON(Result=atru_3)
context_print_19 = ContextPrint(FileToByteArrayWrittenAndReadBytesMatch=test_result_to_json_18)
test_result_to_json_22 = TestResultToJSON(Result=aeq_6)
test_result_to_json_23 = TestResultToJSON(Result=aeq_7)
replace = ReplacePaths(Data=panel_10, Search=panel_17, Replace=panel_19)  # disabled
replace_2 = ReplacePaths(Data=panel_11, Search=panel_21, Replace=panel_22)  # disabled
replace_3 = ReplacePaths(Data=py3_3, Search=panel_15, Replace=panel_16)  # disabled
replace_4 = ReplacePaths(Data=py3_4, Search=panel_18, Replace=panel_20)  # disabled
urle = URLEncode(Text="hello world !!", Encoding="UTF8")
context_print_20 = ContextPrint(Base64ToTextTextMatches=test_result_to_json_20)
ugzip = DecompressData(Compressed=gzip)
alen = AssertListLength(Name="split-text-into-lines\num-lines-matches", List=stil, Length="14")
context_print_21 = ContextPrint(HexToColorColorMatches=test_result_to_json_22)
context_print_22 = ContextPrint(CreateCsvLineOutputMatches=test_result_to_json_23)
context_print_23 = ContextPrint(ReadCsvLineAllLinesMatch=test_result_to_json_21)
panel_23 = Panel(urle)
bal_5 = ByteArrayToList(ByteArray=ugzip)
atru_4 = AssertTrue(Name="save-csv\is-not-null", Value=csv)
atru_5 = AssertTrue(Name="save-text\is-not-null", Value=st)
test_result_to_json_24 = TestResultToJSON(Result=alen)
annl_12 = AssertNotNull(Name="split-text-into-lines\num-lines-matches", Value=swr)
atru_6 = AssertTrue(Name="compress-data\compressed-data-less-than-uncompressed", Value=smaller.SmallerThan)
context_print_24 = ContextPrint(SplitTextIntoLinesNumLinesMatches=test_result_to_json_24)
test_result_to_json_25 = TestResultToJSON(Result=atru_4)
test_result_to_json_26 = TestResultToJSON(Result=atru_5)
lng_5 = ListLength(List=bal_5)
test_result_to_json_27 = TestResultToJSON(Result=annl_12)
aeq_8 = AssertEqual(Name="url-encode\output-matches", Actual=panel_23, Expected="hello+world+%21%21", Tolerance=1e-06)
equals = Equality(FirstNumber=lng_2, SecondNumber=lng_5)  # -> Equality, Inequality
test_result_to_json_28 = TestResultToJSON(Result=atru_6)
context_print_25 = ContextPrint(SplitTextIntoLinesNumLinesMatches=test_result_to_json_27)
context_print_26 = ContextPrint(SaveTextIsNotNull=test_result_to_json_26)
panel_24 = Panel("""NA
NA
NA""")  # disabled
context_print_27 = ContextPrint(SaveCsvIsNotNull=test_result_to_json_25)
merge_2 = Merge(Data1=panel_8, Data2=replace_3, Data3=replace, Data4=replace_4, Data5=replace_2)  # disabled
atru_7 = AssertTrue(Name="compress-data\decompressed-data-same-length-as-compressed", Value=equals.Equality)
test_result_to_json_29 = TestResultToJSON(Result=aeq_8)
context_print_28 = ContextPrint(CompressDataCompressedDataLessThanUncompressed=test_result_to_json_28)
lng_6 = ListLength(List=panel_24)  # disabled
item_2 = ListItem(List=panel_24, Index=0, Wrap=True)  # disabled
test_result_to_json_30 = TestResultToJSON(Result=atru_7)
panel_25 = Panel("replace-empty-branches\replaced-banches-length-matches-1")  # disabled
panel_26 = Panel("replace-empty-branches\replaced-banches-length-matches-2")  # disabled
context_print_29 = ContextPrint(UrlEncodeOutputMatches=test_result_to_json_29)
reb = ReplaceEmptyBranches(Tree=merge_2, Replacement=panel_24)  # disabled
context_print_30 = ContextPrint(CompressDataDecompressedDataSameLengthAsCompressed=test_result_to_json_30)
panel_27 = Panel("1")  # disabled
panel_28 = Panel("3")  # disabled
branch = TreeBranch(Tree=reb, Path=panel_27, MaintainPaths=True)  # disabled
branch_2 = TreeBranch(Tree=reb, Path=panel_28, MaintainPaths=True)  # disabled
panel_29 = Panel("replace-empty-branches\replaced-branch-item-matches-1")  # disabled
panel_30 = Panel("replace-empty-branches\replaced-branch-item-matches-2")  # disabled
alen_2 = AssertListLength(Name=panel_25, List=branch, Length=lng_6)  # disabled
alen_3 = AssertListLength(Name=panel_26, List=branch_2, Length=lng_6)  # disabled
item_3 = ListItem(List=branch, Index=0, Wrap=True)  # disabled
item_4 = ListItem(List=branch_2, Index=0, Wrap=True)  # disabled
panel_31 = Panel(merge_2)  # disabled
test_result_to_json_31 = TestResultToJSON(Result=alen_2)  # disabled
test_result_to_json_32 = TestResultToJSON(Result=alen_3)  # disabled
context_print_31 = ContextPrint(ReplaceEmptyBranchesReplacedBanchesLengthMatches1=test_result_to_json_31)  # disabled
panel_32 = Panel(reb)  # disabled
context_print_32 = ContextPrint(ReplaceEmptyBranchesReplacedBanchesLengthMatches2=test_result_to_json_32)  # disabled
aeq_9 = AssertEqual(Name=panel_29, Actual=item_3, Expected=item_2, Tolerance=1e-06)  # disabled
aeq_10 = AssertEqual(Name=panel_30, Actual=item_4, Expected=item_2, Tolerance=1e-06)  # disabled
test_result_to_json_33 = TestResultToJSON(Result=aeq_9)  # disabled
test_result_to_json_34 = TestResultToJSON(Result=aeq_10)  # disabled
context_print_33 = ContextPrint(ReplaceEmptyBranchesReplacedBranchItemMatches2=test_result_to_json_34)  # disabled
context_print_34 = ContextPrint(ReplaceEmptyBranchesReplacedBranchItemMatches1=test_result_to_json_33)  # disabled
