# Grasshopper definition auth.gh (Grasshopper 1.0.7)
# plug-ins: Swiftlet

value = Panel("Bearer <TOKEN>")
# Token Auth
token = Panel("<TOKEN>")
# API Key
key = Panel("api-key")
# Basic Auth
username = Panel("admin")
password = Panel("<PASSWORD>")
basic = BasicAuth(Username=username, Password=password)
api = APIKey(Key=key, Value=value)  # -> Header, QueryParam
bearer = BearerTokenAuth(Token=token)
qp = QueryParam(api.QueryParam)
H = HttpHeader(api.Header)
H_2 = HttpHeader(basic)
H_3 = HttpHeader(bearer)
header = Panel(H)
query_param = Panel(qp)
header_with_base64_encoded_credentials = Panel(H_2)
header_2 = Panel(H_3)
