# Grasshopper definition json-construct.gh (Grasshopper 1.0.7)
# plug-ins: Swiftlet

panel = Panel("""number_value
bool_value
string_value""")
panel_2 = Panel("""0
0
0""")
panel_3 = Panel("""1
2
0""")
panel_4 = Panel("""2
4
0""")
panel_5 = Panel("""100
true
hello""")
cjv = CreateJSONValue(Value=panel_2)
cjv_2 = CreateJSONValue(Value=panel_3)
cjv_3 = CreateJSONValue(Value=panel_4)
cjv_4 = CreateJSONValue(Value=panel_5)
jv = JValue(cjv)
jv_2 = JValue(cjv_2)
jv_3 = JValue(cjv_3)
cjo = CreateJSONObject(Keys=panel, Values=cjv_4)
cja = CreateJSONArray(JTokens=jv)
cja_2 = CreateJSONArray(JTokens=jv_2)
cja_3 = CreateJSONArray(JTokens=jv_3)
panel_6 = Panel("""first_name
last_name
email""")
merge = Merge(Data1=cja, Data2=cja_2, Data3=cja_3)
panel_7 = Panel("""Jane
Doe
jdoe@gmail.com""")
cja_4 = CreateJSONArray(JTokens=merge)
cjv_5 = CreateJSONValue(Value=panel_7)
ja = JArray(cja_4)
sjk = SetJSONKey(JObject=cjo, Key="polyline", JToken=ja)
jo = JObject(sjk)
cjo_2 = CreateJSONObject(Keys=panel_6, Values=cjv_5)
jo_2 = JObject(cjo_2)
sjk_2 = SetJSONKey(JObject=jo, Key="user", JToken=jo_2)
sjt = StringifyJSONToken(JToken=sjk_2)
json = Panel(sjt)
