# Grasshopper definition swiftlet_examples.gh (Grasshopper 1.0.7)
# plug-ins: Swiftlet

# ----
# SIMPLE REQUESTS
# GET Request
url = Panel("https://httpbin.org/get")
get = GETRequest(URL=url)  # -> Status, Content, Response
status_code = Panel(get.Status)
response = Panel(get.Content)

# ----
# DELETE Request
url_2 = Panel("https://httpbin.org/delete")
delete = DELETERequest(URL=url_2)  # -> Status, Content, Response
status_code_2 = Panel(delete.Status)
response_2 = Panel(delete.Content)

# ----
# Query Params
query_param_keys = Panel("""Long
Lat""")
query_param_values = Panel("""29.9511
-90.0715""")
url_3 = Panel("https://httpbin.org/get")
cqp = CreateQueryParam(Key=query_param_keys, Value=query_param_values)
qp = QueryParam(cqp)
get_2 = GETRequest(URL=url_3, Params=qp)  # -> Status, Content, Response
response_3 = Panel(get_2.Content)
status_code_3 = Panel(get_2.Status)

# ----
# HEADERS, PARAMS AND BODY
# Headers
header_keys = Panel("""Connection
Accept-Encoding
Cache-Control""")
header_values = Panel("""keep-alive
gzip, deflate, br
max-age=0""")
url_4 = Panel("https://httpbin.org/get")
ch = CreateHttpHeader(Key=header_keys, Value=header_values)
H = HttpHeader(ch)
get_3 = GETRequest(URL=url_4, Headers=H)  # -> Status, Content, Response
response_4 = Panel(get_3.Content)
status_code_4 = Panel(get_3.Status)

# ----
# Construct JSON
values = Panel("""value 1
value 2
value 3
value 4
value 5""")
values_2 = Panel("""value 1
value 2
value 3
value 4
value 5""")
int = Integer(10)
num = Number(5.89)
time = Time(637750800000000000)
merge = Merge(Data1="hello", Data2=int, Data3=num, Data4=time, Data5=Toggle(True))
int_2 = Integer("10")
cjv = CreateJSONValue(Value=values_2)
cjv_2 = CreateJSONValue(Value=Toggle(False))
cjv_3 = CreateJSONValue(Value=int_2)
# The "Create JSON Value" component
# lets you convert compatible Grasshopper
# data types to JValue objects
cjv_4 = CreateJSONValue(Value=merge)
# Multiple JTokens (including JValues,
# JObjects and JArrays) can be
# combined into a JArray
cjv_5 = CreateJSONValue(Value=values)
cja = CreateJSONArray(JTokens=cjv_5)
cja_2 = CreateJSONArray(JTokens=cjv)
keys = Panel("""myArray
myValueOne
myValueTwo""")
jv = JValue(cjv_4)
ja = JArray(cja)
merge_2 = Merge(Data1=cja_2, Data2=cjv_2, Data3=cjv_3)
json_values = Panel(jv)
json_array = Panel(ja)
# JObjects can be constructed from
# a list of any type of JToken and
# a corresponding list of keys
cjo = CreateJSONObject(Keys=keys, Values=merge_2)
jo = JObject(cjo)
json_object = Panel(jo)
sjt = StringifyJSONToken(JToken=jv)
sjt_2 = StringifyJSONToken(JToken=ja)
sjt_3 = StringifyJSONToken(JToken=jo)
cjv_6 = CreateJSONValue(Value="hello")
# It is possible to add keys to an
# existing JObject
sjk = SetJSONKey(JObject=jo, Key="myValueThree", JToken=cjv_6)
json = Panel(sjt)
json_2 = Panel(sjt_2)
json_3 = Panel(sjt_3)
sjt_4 = StringifyJSONToken(JToken=sjk)
# It is also possible to remove a key
# from a JObject
rjk = RemoveJSONKey(JObject=sjk, Key="myArray")
json_4 = Panel(sjt_4)
sjt_5 = StringifyJSONToken(JToken=rjk)
json_5 = Panel(sjt_5)

username = Panel("admin")
password = Panel("password")
# AUTH
# Basic Auth
url_5 = Panel("https://httpbin.org/get")
basic = BasicAuth(Username=username, Password=password)
get_4 = GETRequest(URL=url_5, Headers=basic)  # -> Status, Content, Response
status_code_5 = Panel(get_4.Status)
response_5 = Panel(get_4.Content)

# ----
# Bearer Token
bearer_token = Panel("P9FJE7MPA4E14PSWFMG2")
url_6 = Panel("https://httpbin.org/get")
bearer = BearerTokenAuth(Token=bearer_token)
get_5 = GETRequest(URL=url_6, Headers=bearer)  # -> Status, Content, Response
status_code_6 = Panel(get_5.Status)
response_6 = Panel(get_5.Content)

# ----
# API Token
url_7 = Panel("https://httpbin.org/get")
key = Panel("Token")
token = Panel("P9FJE7MPA4E14PSWFMG2")
api = APIKey(Key=key, Value=token)  # -> Header, QueryParam
get_6 = GETRequest(URL=url_7, Headers=api.Header)  # -> Status, Content, Response
status_code_7 = Panel(get_6.Status)
response_7 = Panel(get_6.Content)

# ----
# Parsing JSON
json_6 = Panel("""{
  "object-value": {
    "val1": 1,
    "val2": 2,
    "val3": 3
  },
  "another-object": {
    "val1": [
      "hello",
      "world"
    ]
  },
  "array-value": [
    {
      "hello": "world"
    },
    {
      "hello": "world"
    }
  ],
  "value1": 10,
  "value2": "hello",
  "value3": true
}""")
pjs = ParseJSONString(Text=json_6)
panel = Panel(pjs)
rjo = ReadJSONObject(JObject=pjs)  # -> Keys, JTokens
keys_2 = Panel(rjo.Keys)
values_3 = Panel(rjo.JTokens)
sjt_6 = SeparateJSONTokens(JTokens=rjo.JTokens)  # -> JObjects, JArrays, JValues
objects = Panel(sjt_6.JObjects)
arrays = Panel(sjt_6.JArrays)
values_4 = Panel(sjt_6.JValues)
rja = ReadJSONArray(Array=sjt_6.JArrays)
gjok = GetJSONObjectKey(JObject=sjt_6.JObjects, Key="val1")
gjok_2 = GetJSONObjectKey(JObject=rja, Key="hello")
panel_2 = Panel(gjok)
sjt_7 = SeparateJSONTokens(JTokens=gjok)  # -> JObjects, JArrays, JValues
rja_2 = ReadJSONArray(Array=sjt_7.JArrays)
rjv = ReadJSONValue(JValue=rja_2)  # -> AsString, AsNumber, AsBool
rjv_2 = ReadJSONValue(JValue=sjt_7.JValues)  # -> AsString, AsNumber, AsBool
rjv_3 = ReadJSONValue(JValue=gjok_2)  # -> AsString, AsNumber, AsBool
rjv_4 = ReadJSONValue(JValue=sjt_6.JValues)  # -> AsString, AsNumber, AsBool
value = Panel(rjv_2.AsNumber)
value_2 = Panel(rjv.AsString)
value_3 = Panel(rjv_3.AsString)
as_string = Panel(rjv_4.AsString)
as_number = Panel(rjv_4.AsNumber)
as_boolean = Panel(rjv_4.AsBool)

# ----
# Formatting JSON String
# You can format a JSON string for
# readability
unformatted_json = Panel("""{
"object-value" : { "val1" : 1,
"val2" : 2,
"val3" : 3
},
"another-object":{
"val1" : [
"hello", "world"
]
}
,
"array-value":[
{"hello" : "world"},
{"hello" : "world"}
],
"value1" : 10,
"value2" : "hello",
"value3" : true
}""")
fjs = FormatJsonString(JSONString=unformatted_json)
pretty_json = Panel(fjs)

# ----
# Parsing JSON Response
url_8 = Panel("https://httpbin.org/get")
get_7 = GETRequest(URL=url_8)  # -> Status, Content, Response
status_code_8 = Panel(get_7.Status)
pjs_2 = ParseJSONString(Text=get_7.Content)
jt = JToken(pjs_2)
rjo_2 = ReadJSONObject(JObject=jt)  # -> Keys, JTokens
keys_3 = Panel(rjo_2.Keys)
tokens = Panel(rjo_2.JTokens)
sjt_8 = SeparateJSONTokens(JTokens=rjo_2.JTokens)  # -> JObjects, JArrays, JValues
rja_3 = ReadJSONArray(Array=sjt_8.JArrays)
rjv_5 = ReadJSONValue(JValue=sjt_8.JValues)  # -> AsString, AsNumber, AsBool
rjo_3 = ReadJSONObject(JObject=sjt_8.JObjects)  # -> Keys, JTokens
panel_3 = Panel(rjv_5.AsString)

# ----
# JSON Parsing
# Casting hierarchy
# A generic JSON value is called a JToken.
#  Depending on what this value actually is,
# it can be cast as JObject, JArray or JValue
jt_2 = JToken()
jo_2 = JObject(jt_2)
ja_2 = JArray(jt_2)
jv_2 = JValue(jt_2)

# ----
# PATCH Request
patch_body = Panel("{ \"Hello\" : \"World\" }")
url_9 = Panel("https://httpbin.org/patch")

ctb = CreateTextBody(
    Content=patch_body,
    IsHtmlChecked=False,
    IsJavascriptChecked=False,
    IsJsonChecked=True,
    IsTextChecked=False,
    IsXmlChecked=False)

patch = PATCHRequest(URL=url_9, Body=ctb)  # -> Status, Content, Response
response_8 = Panel(patch.Content)
status_code_9 = Panel(patch.Status)

# ----
# PUT Request
patch_body_2 = Panel("{ \"Hello\" : \"World\" }")
url_10 = Panel("https://httpbin.org/put")

ctb_2 = CreateTextBody(
    Content=patch_body_2,
    IsHtmlChecked=False,
    IsJavascriptChecked=False,
    IsJsonChecked=True,
    IsTextChecked=False,
    IsXmlChecked=False)

put = PUTRequest(URL=url_10, Body=ctb_2)  # -> Status, Content, Response
status_code_10 = Panel(put.Status)
response_9 = Panel(put.Content)

# ----
# POST Request
url_11 = Panel("https://httpbin.org/post")
post_body = Panel("{ \"Hello\" : \"World\" }")

ctb_3 = CreateTextBody(
    Content=post_body,
    IsHtmlChecked=False,
    IsJavascriptChecked=False,
    IsJsonChecked=True,
    IsTextChecked=False,
    IsXmlChecked=False)

post = POSTRequest(URL=url_11, Body=ctb_3)  # -> Status, Content, Response
status_code_11 = Panel(post.Status)
response_10 = Panel(post.Content)

# ----
# Request Body
url_12 = Panel("https://httpbin.org/post")
post_body_2 = Panel("{ \"Hello\" : \"World\" }")
post_body_3 = Panel("Some Text")
post_body_4 = Panel("""function SomeJS(){
}""")
post_body_5 = Panel("""<!DOCTYPE html>
<html>
<head>
<title>My HTML</title>
</head>
<body>
<p>Hello World</p>
</body>
</html>""")
post_body_6 = Panel("""<?xml version="1.0" encoding="UTF-8"?>
<myxml>
<value>Some value</value>
</myxml>""")

ctb_4 = CreateTextBody(
    Content=post_body_2,
    IsHtmlChecked=False,
    IsJavascriptChecked=False,
    IsJsonChecked=True,
    IsTextChecked=False,
    IsXmlChecked=False)
ctb_5 = CreateTextBody(
    Content=post_body_3,
    IsHtmlChecked=False,
    IsJavascriptChecked=False,
    IsJsonChecked=False,
    IsTextChecked=True,
    IsXmlChecked=False)
ctb_6 = CreateTextBody(
    Content=post_body_4,
    IsHtmlChecked=False,
    IsJavascriptChecked=True,
    IsJsonChecked=False,
    IsTextChecked=False,
    IsXmlChecked=False)
ctb_7 = CreateTextBody(
    Content=post_body_5,
    IsHtmlChecked=True,
    IsJavascriptChecked=False,
    IsJsonChecked=False,
    IsTextChecked=False,
    IsXmlChecked=False)
ctb_8 = CreateTextBody(
    Content=post_body_6,
    IsHtmlChecked=False,
    IsJavascriptChecked=False,
    IsJsonChecked=False,
    IsTextChecked=False,
    IsXmlChecked=True)

post_2 = POSTRequest(URL=url_12, Body=ctb_4)  # -> Status, Content, Response
response_11 = Panel(post_2.Content)
status_code_12 = Panel(post_2.Status)
