# Grasshopper definition iris-3d.gh (Grasshopper 1.0.7)
# plug-ins: Swiftlet

# ----
# SWIFTLET IRIS 3D
# This exampe shows how to use Swiftlet in order to call
# into a local Flask server that hosts a PyTorch classifier
# trained on the Iris dataset. This definition also
# demonstrates parsing server's response and then
# using it in order to color-code geometry in Grasshopper
# 
# IMPORTANT: For this definition to work, the
# Python Flask server must be running locally
# on your machine. Please, refer to the README.md
# file in the same directory for setup instructions
# 
# You can read more about the Iris dataset here:
# https://archive.ics.uci.edu/ml/datasets/iris
# IRIS INPUT DATA
sepal_length_cm = Panel("""5.1
4.9
4.7
4.6
5
5.4
4.6
5
4.4
4.9
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""")
sepal_width_cm = Panel("""3.5
3
3.2
3.1
3.6
3.9
3.4
3.4
2.9
3.1
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""")
petal_length_cm = Panel("""1.4
1.4
1.3
1.5
1.4
1.7
1.4
1.5
1.4
1.5
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""")
petal_width_cm = Panel("""0.2
0.2
0.2
0.2
0.2
0.4
0.3
0.2
0.2
0.1
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""")

# ---- group: Standard
crv = Curve(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)

# ---- group: Sepal Lengths
num = Number(graft(sepal_length_cm))

# ---- group: Sepal Widths
num_2 = Number(graft(sepal_width_cm))

# ---- group: Petal Widths
num_3 = Number(graft(petal_width_cm))

# ---- group: Petal Lengths
num_4 = Number(graft(petal_length_cm))

# ----
number_slider = Slider(200, range=0..1000)
lng = ListLength(List=sepal_length_cm)
rectangle = Rectangle(Plane=PlaneXY(0, 0, 0), XSize=sepal_width_cm, YSize=sepal_length_cm, Radius=0)  # -> Rectangle, Length
rectangle_2 = Rectangle(Plane=PlaneXY(0, 0, 0), XSize=petal_width_cm, YSize=petal_length_cm, Radius=0)  # -> Rectangle, Length
division = Division(A=petal_width_cm, B=2)
division_2 = Division(A=sepal_width_cm, B=2)
petal = Curve(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)
# CONSTRUCT IRIS FLOWERS
sepal = Curve(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)
X = UnitX(Factor=division)
X_2 = UnitX(Factor=division_2)
rev = Reverse(Vector=X)
rev_2 = Reverse(Vector=X_2)
random = Random(Range=number_slider, Number=lng, Seed=2)
random_2 = Random(Range=number_slider, Number=lng, Seed="10")
move = Move(Geometry=rectangle_2.Rectangle, Motion=rev)  # -> Geometry, Transform
move_2 = Move(Geometry=rectangle.Rectangle, Motion=rev_2)  # -> Geometry, Transform
bbox = BoundingBox(Content=petal, Plane=PlaneXY(0, 0, 0))  # -> Box, Box_2
bbox_2 = BoundingBox(Content=sepal, Plane=PlaneXY(0, 0, 0))  # -> Box, Box_2
bbox_3 = BoundingBox(Content=crv, Plane=PlaneXY(0, 0, 0))  # -> Box, Box_2
series = Series(Start="0", Step="0.08", Count="12")
series_2 = Series(Start="0", Step="0.1", Count=10)
graph = GraphMapper(
    series,
    x0=0,
    x1=1,
    y0=0,
    y1=1,
    container_name="Bezier",
    cpx=[0, 0.388068974, 0.6230280399, 1],
    cpy=[0, 0.9623371363, 0.9413949847, 0])
series_3 = Series(Start="0", Step="0.08", Count="12")
series_4 = Series(Start="0", Step="0.1", Count=10)
series_5 = Series(Start="0", Step="0.08", Count="12")
series_6 = Series(Start="0", Step="0.1", Count=10)
graph_2 = GraphMapper(
    series_3,
    x0=0,
    x1=1,
    y0=0,
    y1=1,
    container_name="Bezier",
    cpx=[0, 0.3955157399, 0.5952306986, 1],
    cpy=[0, 0.627687335, 0.7567421794, 0.4096281528])
graph_3 = GraphMapper(
    series_5,
    x0=0,
    x1=1,
    y0=0,
    y1=1,
    container_name="Bezier",
    cpx=[0, 0.01866981015, 1, 1],
    cpy=[0, 0.4968898892, 0.2932420969, 0.9772869349])
Z = UnitZ(Factor=graph)
panel = Panel(graph)
Z_2 = UnitZ(Factor=graph_2)
panel_2 = Panel(graph_2)
Z_3 = UnitZ(Factor=graph_3)
panel_3 = Panel(graph_3)
Z_4 = UnitZ(Factor=1)
Z_5 = UnitZ(Factor=1)
Z_6 = UnitZ(Factor=1)
panel_4 = Panel("""0
120
-120""")
rad = Radians(Degrees=panel_4)
panel_5 = Panel("""0
120
-120""")
panel_6 = Panel("""60
-60
180""")
rad_2 = Radians(Degrees=panel_5)
rad_3 = Radians(Degrees=panel_6)
random_3 = Random(Range="180", Number=lng, Seed=2)
rad_4 = Radians(Degrees=random_3)  # -> graft(Radians)
merge = Merge(Data1=num, Data2=num_2, Data3=num_4, Data4=num_3)

# ---- group: X
num_5 = Number(random_2)

# ---- group: Y
num_6 = Number(random)

# ---- group: Sepal Dimensions
boundary = BoundarySurfaces(Edges=move_2.Geometry)

# ---- group: Petal Dimensions
boundary_2 = BoundarySurfaces(Edges=move.Geometry)

# ----
pt = ConstructPoint(XCoordinate=num_5, YCoordinate=num_6, ZCoordinate=0)
map_srf = MapToSurface(Curve=sepal, Source=bbox_2.Box, Target=boundary)  # -> graft(Curve)
map_srf_2 = MapToSurface(Curve=petal, Source=bbox.Box, Target=boundary_2)  # -> graft(Curve)
map_srf_3 = MapToSurface(Curve=crv, Source=bbox_3.Box, Target=boundary_2)  # -> graft(Curve)
standard = Curve(map_srf_3)
petal_2 = Curve(map_srf_2)
edges = BrepEdges(Brep=boundary)  # -> Naked, Interior, NonManifold
sepal_2 = Curve(map_srf)
item = ListItem(List=edges.Naked, Index=0, Wrap=True)  # -> Item, Item1, Item2
edges_2 = BrepEdges(Brep=boundary_2)  # -> Naked, Interior, NonManifold
edges_3 = BrepEdges(Brep=boundary_2)  # -> Naked, Interior, NonManifold
crv_2 = Curve(item.Item)
crv_3 = Curve(item.Item2)
item_2 = ListItem(List=edges_2.Naked, Index=0, Wrap=True)  # -> Item, Item1, Item2
item_3 = ListItem(List=edges_3.Naked, Index=0, Wrap=True)  # -> Item, Item1, Item2
flip = FlipCurve(Curve=crv_3)  # -> Curve, Flag
crv_4 = Curve(item_2.Item)
crv_5 = Curve(item_2.Item2)
crv_6 = Curve(item_3.Item)
crv_7 = Curve(item_3.Item2)
tweencrv = TweenCurve(CurveA=crv_2, CurveB=flip.Curve, Factor=series_2, BlendType=0)
flip_2 = FlipCurve(Curve=crv_5)  # -> Curve, Flag
flip_3 = FlipCurve(Curve=crv_7)  # -> Curve, Flag
merge_2 = Merge(Data1=crv_2, Data2=tweencrv, Data3=flip.Curve)
tweencrv_2 = TweenCurve(CurveA=crv_4, CurveB=flip_2.Curve, Factor=series_4, BlendType=0)
tweencrv_3 = TweenCurve(CurveA=crv_6, CurveB=flip_3.Curve, Factor=series_6, BlendType=0)
move_3 = Move(Geometry=merge_2, Motion=Z)  # -> Geometry, Transform
merge_3 = Merge(Data1=crv_4, Data2=tweencrv_2, Data3=flip_2.Curve)
merge_4 = Merge(Data1=crv_6, Data2=tweencrv_3, Data3=flip_3.Curve)
loft = Loft(Curves=move_3.Geometry, Options={Adjust=False, Closed=False, LoftEnds=0, LoftSimp=0, LoftType=0, Rebuild=10, Refit=0.01})
move_4 = Move(Geometry=merge_3, Motion=Z_2)  # -> Geometry, Transform
move_5 = Move(Geometry=merge_4, Motion=Z_3)  # -> Geometry, Transform
scale_nu = ScaleNU(Geometry=loft, Plane=PlaneXY(0, 0, 0), ScaleX=1, ScaleY=1, ScaleZ=Slider(5.46, range=0..10))  # -> Geometry, Transform
loft_2 = Loft(Curves=move_4.Geometry, Options={Adjust=False, Closed=False, LoftEnds=0, LoftSimp=0, LoftType=0, Rebuild=10, Refit=0.01})
loft_3 = Loft(Curves=move_5.Geometry, Options={Adjust=False, Closed=False, LoftEnds=0, LoftSimp=0, LoftType=0, Rebuild=10, Refit=0.01})
scale_nu_2 = ScaleNU(Geometry=loft_2, Plane=PlaneXY(0, 0, 0), ScaleX=1, ScaleY=1, ScaleZ=Slider(10, range=0..10))  # -> Geometry, Transform
scale_nu_3 = ScaleNU(Geometry=loft_3, Plane=PlaneXY(0, 0, 0), ScaleX=1, ScaleY=1, ScaleZ=Slider(10, range=0..10))  # -> Geometry, Transform
project = Project(Curve=sepal_2, Brep=scale_nu.Geometry, Direction=Z_4)
srfsplit = SurfaceSplit(Surface=scale_nu.Geometry, Curves=project)
project_2 = Project(Curve=standard, Brep=scale_nu_2.Geometry, Direction=Z_5)
project_3 = Project(Curve=petal_2, Brep=scale_nu_3.Geometry, Direction=Z_6)
item_4 = ListItem(List=srfsplit, Index=0, Wrap=True)
srfsplit_2 = SurfaceSplit(Surface=scale_nu_2.Geometry, Curves=project_2)
srfsplit_3 = SurfaceSplit(Surface=scale_nu_3.Geometry, Curves=project_3)
item_5 = ListItem(List=srfsplit_2, Index=1, Wrap=True)
rotate = Rotate(Geometry=item_4, Angle=rad, Plane=PlaneXY(0, 0, 0))  # -> Geometry, Transform
item_6 = ListItem(List=srfsplit_3, Index=0, Wrap=True)
rotate_2 = Rotate(Geometry=item_5, Angle=rad_2, Plane=PlaneXY(0, 0, 0))  # -> Geometry, Transform
rotate_3 = Rotate(Geometry=item_6, Angle=rad_3, Plane=PlaneXY(0, 0, 0))  # -> Geometry, Transform

# ---- group: Iris Origins
pt_2 = Point(pt)

# ---- group: Sepal Geometry
geo = Geometry(rotate.Geometry)

# ---- group: Petal Geometry
geo_2 = Geometry(rotate_3.Geometry)

# ---- group: Standard Geometry
geo_3 = Geometry(rotate_2.Geometry)

# ---- group: Sepal Geometry
geo_4 = Geometry(geo)

# ---- group: Petal Geometry
geo_5 = Geometry(geo_2)

# ---- group: Standard Geometry
geo_6 = Geometry(geo_3)

# ----
debrep = DeconstructBrep(Brep=geo)  # -> Faces, Edges, Vertices
item_7 = ListItem(List=debrep.Edges, Index=0, Wrap=True)  # -> Item, Item1
debrep_2 = DeconstructBrep(Brep=geo_2)  # -> Faces, Edges, Vertices
trim = TrimTree(Tree=item_7.Item1, Depth=1)
debrep_3 = DeconstructBrep(Brep=geo_3)  # -> Faces, Edges, Vertices
item_8 = ListItem(List=debrep_2.Edges, Index=0, Wrap=True)  # -> Item, Item1
item_9 = ListItem(List=trim, Index=0, Wrap=True)
trim_2 = TrimTree(Tree=item_8.Item1, Depth=1)
item_10 = ListItem(List=debrep_3.Edges, Index=0, Wrap=True)  # -> Item, Item1, Item2
item_11 = ListItem(List=trim_2, Index=0, Wrap=True)
trim_3 = TrimTree(Tree=item_10.Item2, Depth=1)
item_12 = ListItem(List=trim_3, Index=0, Wrap=True)

# ---- group: Local Origin
midpt = CurveMiddle(Curve=item_9)

midpt_2 = CurveMiddle(Curve=item_11)

midpt_3 = CurveMiddle(Curve=item_12)

# ----
vec2pt = Vector2Pt(PointA=midpt, PointB=graft(pt_2), Unitize=False)  # -> Vector, Length
vec2pt_2 = Vector2Pt(PointA=midpt_2, PointB=graft(pt_2), Unitize=False)  # -> Vector, Length
move_6 = Move(Geometry=geo_4, Motion=vec2pt.Vector)  # -> Geometry, Transform
vec2pt_3 = Vector2Pt(PointA=midpt_3, PointB=graft(pt_2), Unitize=False)  # -> Vector, Length
move_7 = Move(Geometry=geo_5, Motion=vec2pt_2.Vector)  # -> Geometry, Transform
move_8 = Move(Geometry=geo_6, Motion=vec2pt_3.Vector)  # -> Geometry, Transform
merge_5 = Merge(Data1=move_6.Geometry, Data2=move_7.Geometry, Data3=move_8.Geometry)
bbox_4 = BoundingBox(Content=merge_5, Plane=PlaneXY(0, 0, 0), UnionBox=True)  # -> Box, Box_2
volume = Volume(Geometry=bbox_4.Box)  # -> Volume, Centroid
rotate_4 = Rotate(Geometry=merge_5, Angle=rad_4, Plane=volume.Centroid)  # -> Geometry, Transform

# ---- group: Iris Flowers
geo_7 = Geometry(simplify(rotate_4.Geometry))

# COLOR THE FLOWERS
geo_8 = Geometry(geo_7)

# ----
# SEND REQUEST TO THE SERVER
# Hit the "/predict-iris" route of the Flask server in order to determine Iris type.
# 
# IMPORTANT: This will only work if the Python Flask server is running locally on your machine.
# Run the train.py file in order to generate the model, then run the server.py to start the server
# Create a JSON object
# for each flower
# Create a single
# JSON array for
# all objects
# Stringify JSON Array
# Create request body
keys = Panel("""sepal_length_cm
sepal_width_cm
petal_length_cm
petal_width_cm""")
values = Panel(merge)
num_7 = Number(values)
cjv = CreateJSONValue(Value=num_7)
cjo = CreateJSONObject(Keys=keys, Values=cjv)
jo = JObject(flatten(cjo))
cja = CreateJSONArray(JTokens=jo)
ja = JArray(cja)
sjt = StringifyJSONToken(JToken=ja)
stringified_json = Panel(sjt)
url = Panel("http://127.0.0.1:8000/predict-iris")

ctb = CreateTextBody(Content=sjt, IsHtmlChecked=False, IsJavascriptChecked=False, IsJsonChecked=True, IsTextChecked=False, IsXmlChecked=False)

post = POSTRequest(URL=url, Body=ctb)  # -> Status, Content, Response

pjs = ParseJSONString(Text=post.Content)
# PARSE THE RESPONSE
parsed_response = Panel(pjs)
rja = ReadJSONArray(Array=pjs)
parsed_json_array = Panel(rja)
rjv = ReadJSONValue(JValue=rja)  # -> AsString, AsNumber, AsBool
parsed_json_values = Panel(rjv.AsString)

python = GhPythonScript(iris_class=rjv.AsString)  # -> isSetosa, isVersicolour, isVirginica
# ---------- python: Python ----------
isSetosa = iris_class == "Iris Setosa" 
isVersicolour = iris_class == "Iris Versicolour"
isVirginica = iris_class == "Iris Virginica"
# ---------- end python ----------
cull = CullPattern(List=geo_8, CullPattern=graft(python.isVersicolour))
cull_2 = CullPattern(List=geo_8, CullPattern=graft(python.isSetosa))
cull_3 = CullPattern(List=geo_8, CullPattern=graft(python.isVirginica))
preview = CustomPreview(Geometry=cull_2, Material=ColourSwatch(SwatchColor=RGB(217, 0, 255)))
preview_2 = CustomPreview(Geometry=cull, Material=ColourSwatch(SwatchColor=RGB(0, 162, 255)))
preview_3 = CustomPreview(Geometry=cull_3, Material=ColourSwatch(SwatchColor=RGB(0, 255, 47)))
