# Grasshopper definition iris-simple.gh (Grasshopper 1.0.7)
# plug-ins: Swiftlet

# ----
# SWIFTLET IRIS 3D
# This is a simple example that demonstrates how to
# use Swiftlet in order to call into a local Flask server
# that hosts a PyTorch classifier trained on the Iris dataset
# 
# IMPORTANT: For this definition to work, the
# Python Flask server must be running locally
# on your machine. Please, refer to the README.md
# file in the same directory for setup instructions
# 
# You can read more about the Iris dataset here:
# https://archive.ics.uci.edu/ml/datasets/iris
# IRIS INPUT DATA
sepal_length_cm = Panel("""5.1
4.9
4.7
4.6
5
5.4
4.6
5
4.4
4.9
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""")
sepal_width_cm = Panel("""3.5
3
3.2
3.1
3.6
3.9
3.4
3.4
2.9
3.1
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""")
petal_length_cm = Panel("""1.4
1.4
1.3
1.5
1.4
1.7
1.4
1.5
1.4
1.5
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""")
petal_width_cm = Panel("""0.2
0.2
0.2
0.2
0.2
0.4
0.3
0.2
0.2
0.1
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""")

# ---- group: Sepal Lengths
num = Number(graft(sepal_length_cm))

# ---- group: Sepal Widths
num_2 = Number(graft(sepal_width_cm))

# ---- group: Petal Widths
num_3 = Number(graft(petal_width_cm))

# ---- group: Petal Lengths
num_4 = Number(graft(petal_length_cm))

# ----
merge = Merge(Data1=num, Data2=num_2, Data3=num_4, Data4=num_3)

# ----
# SEND REQUEST TO THE SERVER
# Hit the "/predict-iris" route of the Flask server in order to determine Iris type
# 
# IMPORTANT: This will only work if the Python Flask server is running locally on your machine.
# Run the train.py file in order to generate the model, then run the server.py to start the server
# Create a JSON object
# for each flower
# Create a single
# JSON array for
# all objects
# Stringify JSON Array
# Create request body
keys = Panel("""sepal_length_cm
sepal_width_cm
petal_length_cm
petal_width_cm""")
values = Panel(merge)
num_5 = Number(values)
cjv = CreateJSONValue(Value=num_5)
cjo = CreateJSONObject(Keys=keys, Values=cjv)
jo = JObject(flatten(cjo))
cja = CreateJSONArray(JTokens=jo)
ja = JArray(cja)
sjt = StringifyJSONToken(JToken=ja)
stringified_json = Panel(sjt)
url = Panel("http://127.0.0.1:8000/predict-iris")

ctb = CreateTextBody(Content=sjt, IsHtmlChecked=False, IsJavascriptChecked=False, IsJsonChecked=True, IsTextChecked=False, IsXmlChecked=False)

post = POSTRequest(URL=url, Body=ctb)  # -> Status, Content, Response

pjs = ParseJSONString(Text=post.Content)
# PARSE THE RESPONSE
parsed_response = Panel(pjs)
rja = ReadJSONArray(Array=pjs)
parsed_json_array = Panel(rja)
rjv = ReadJSONValue(JValue=rja)  # -> AsString, AsNumber, AsBool
parsed_json_values = Panel(rjv.AsString)
