# Grasshopper definition swiftlet-http-listener.gh (Grasshopper 1.0.7)
# plug-ins: Swiftlet

pre_canned_response = Panel("""{
    "received" : true,
    "err" : null
}""")
route = Panel("grasshopper")
port = Panel("1917")
ctb = CreateTextBody(
    Content=pre_canned_response,
    IsHtmlChecked=False,
    IsJavascriptChecked=False,
    IsJsonChecked=True,
    IsTextChecked=False,
    IsXmlChecked=False)
L = HTTPListener(Port=port, Route=route, ResponseBody=ctb)  # -> Method, Headers, QueryParams, Content
request_method = Panel(L.Method)
request_body = Panel(L.Content)
