# Grasshopper definition swiftlet-socket-listener.gh (Grasshopper 1.0.7)
# plug-ins: Swiftlet

panel = Panel("""{"type":"subscribe","symbol":"AAPL"}
{"type":"subscribe","symbol":"AMZN"}
{"type":"subscribe","symbol":"BINANCE:BTCUSDT"}
{"type":"subscribe","symbol":"IC MARKETS:1"}""")

# ----
# Go to https://finnhub.io/
# to get your free API key
panel_2 = Panel("<YOUR TOKEN HERE>")

socket_url = Panel("wss://ws.finnhub.io")
cqp = CreateQueryParam(Key="token", Value=panel_2)
dam = DataDam(DataA=socket_url, BufferDelay=10000000, BufferMode=0)
# This is a brand new component,
# so use it at your own risk. Also, it is a bit
# hard to stop once it gets going. One
# hacky workaround is disconnecting
# from the internet and waiting for a few seconds.
socket = SocketListener(URL=dam, Params=cqp, OnOpen=panel)
pjs = ParseJSONString(Text=socket)
gjok = GetJSONObjectKey(JObject=pjs, Key="type")
gjok_2 = GetJSONObjectKey(JObject=pjs, Key="data")
rjv = ReadJSONValue(JValue=gjok)  # -> AsString, AsNumber, AsBool
rja = ReadJSONArray(Array=gjok_2)
gjok_3 = GetJSONObjectKey(JObject=rja, Key="c")
gjok_4 = GetJSONObjectKey(JObject=rja, Key="p")
gjok_5 = GetJSONObjectKey(JObject=rja, Key="s")
gjok_6 = GetJSONObjectKey(JObject=rja, Key="t")
gjok_7 = GetJSONObjectKey(JObject=rja, Key="v")
type = Panel(rjv.AsString)
rja_2 = ReadJSONArray(Array=gjok_3)
rjv_2 = ReadJSONValue(JValue=gjok_4)  # -> AsString, AsNumber, AsBool
rjv_3 = ReadJSONValue(JValue=gjok_5)  # -> AsString, AsNumber, AsBool
rjv_4 = ReadJSONValue(JValue=gjok_6)  # -> AsString, AsNumber, AsBool
rjv_5 = ReadJSONValue(JValue=gjok_7)  # -> AsString, AsNumber, AsBool
rjv_6 = ReadJSONValue(JValue=rja_2)  # -> AsString, AsNumber, AsBool
trade_conditions = Panel(rjv_6.AsNumber)
last_price = Panel(rjv_2.AsNumber)
symbol = Panel(rjv_3.AsString)
timestamp = Panel(rjv_4.AsString)
volume = Panel(rjv_5.AsNumber)
