# Grasshopper definition swiftlet-chat-gpt-example.gh (Grasshopper 1.0.7)
# plug-ins: Swiftlet

model = Panel("gpt-3.5-turbo")
temperature = Slider(0.7, range=0..1)
prompt = Panel("Why did the chicken cross the road?")

# ----
# Get your API key at
# https://platform.openai.com/account/api-keys
api_key = Panel("YOUR API KEY HERE")

role = Panel("user")
cjv = CreateJSONValue(Value=role)
cjv_2 = CreateJSONValue(Value=prompt)
keys = Panel("""role
content""")
merge = Merge(Data1=cjv, Data2=cjv_2)
cjo = CreateJSONObject(Keys=keys, Values=merge)
keys_2 = Panel("""model
messages
temperature""")
cja = CreateJSONArray(JTokens=cjo)
cjv_3 = CreateJSONValue(Value=model)
cjv_4 = CreateJSONValue(Value=temperature)
merge_2 = Merge(Data1=cjv_3, Data2=cja, Data3=cjv_4)
cjo_2 = CreateJSONObject(Keys=keys_2, Values=merge_2)
text_completion_url = Panel("https://api.openai.com/v1/chat/completions")
ctb = CreateTextBody(
    Content=cjo_2,
    IsHtmlChecked=False,
    IsJavascriptChecked=False,
    IsJsonChecked=True,
    IsTextChecked=False,
    IsXmlChecked=False)
bearer = BearerTokenAuth(Token=api_key)
post = POSTRequest(URL=text_completion_url, Body=ctb, Headers=bearer)  # -> Status, Content, Response
pjs = ParseJSONString(Text=post.Content)
gjok = GetJSONObjectKey(JObject=pjs, Key="choices")
rja = ReadJSONArray(Array=gjok)
gjok_2 = GetJSONObjectKey(JObject=rja, Key="message")
gjok_3 = GetJSONObjectKey(JObject=gjok_2, Key="content")
rjv = ReadJSONValue(JValue=gjok_3)  # -> AsString, AsNumber, AsBool
response = Panel(rjv.AsString)
