# Grasshopper definition swiftlet-dalle-example.gh (Grasshopper 1.0.7)
# plug-ins: Swiftlet

# ----
# Get your API key at
# https://platform.openai.com/account/api-keys
api_key = Panel("YOUR API KEY HERE")

keys = Panel("""prompt
n
size""")
prompt = Panel("Cheshire cat on Mars photorealistic HD")
filename_without_file_extension = Panel("my-test-image")
number_of_images = Slider(5, range=1..10)
image_size = ValueList({"256x256", "512x512", "1024x1024"}, selected="1024x1024")
dall_e_url = Panel("https://api.openai.com/v1/images/generations")
int = Integer(number_of_images)
cjv = CreateJSONValue(Value=prompt)
cjv_2 = CreateJSONValue(Value=int)
cjv_3 = CreateJSONValue(Value=image_size)
bearer = BearerTokenAuth(Token=api_key)
merge = Merge(Data1=cjv, Data2=cjv_2, Data3=cjv_3)
cjo = CreateJSONObject(Keys=keys, Values=merge)
ctb = CreateTextBody(Content=cjo, IsHtmlChecked=False, IsJavascriptChecked=False, IsJsonChecked=True, IsTextChecked=False, IsXmlChecked=False)
post = POSTRequest(URL=dall_e_url, Body=ctb, Headers=bearer)  # -> Status, Content, Response
pjs = ParseJSONString(Text=post.Content)
gjok = GetJSONObjectKey(JObject=pjs, Key="data")
rja = ReadJSONArray(Array=gjok)
gjok_2 = GetJSONObjectKey(JObject=rja, Key="url")
rjv = ReadJSONValue(JValue=gjok_2)  # -> AsString, AsNumber, AsBool
durl = DeconstructURL(URL=rjv.AsString)  # -> graft(Base), Scheme, Host, Route, Params

# ----
# Save results to disk
get = GETRequest(URL=durl.Base, Params=durl.Params)  # -> Status, Content, flatten(Response)
lng = ListLength(List=get.Response)
series = Series(Start=1, Step=1, Count=lng)
python = GhPythonScript(image_name=filename_without_file_extension, image_number=series)  # -> filepath; inputs image_number: Int32
# ---------- python: Python ----------
import os
desktop = os.path.join(os.path.join(os.environ['USERPROFILE']), 'Desktop') 
filepath = os.path.join(desktop, "{0}-{1}.png".format(image_name, image_number))
# ---------- end python ----------
filepath_to_save_output_image = Panel(python)
swr = SaveWebResponse(Response=get.Response, Path=filepath_to_save_output_image, binaryChecked=True, textChecked=False)

# ----
# Preview Images in Rhino
number_slider = Slider(0, range=0..9)
item = ListItem(List=filepath_to_save_output_image, Index=number_slider, Wrap=True)
img = ImportImage(File=item)
