# Grasshopper definition server_demo.gh (Grasshopper 1.0.8)
# plug-ins: Swiftlet

port = Panel("1900")
si = ServerInput(Port=port)  # -> VoronoiVolume, VoronoiArea
dereq = DeconstructRequest(Request=si.VoronoiVolume)  # -> Request, Method, Route, Headers, Query, Body
dereq_2 = DeconstructRequest(Request=si.VoronoiArea)  # -> Request, Method, Route, Headers, Query, Body
db = DeconstructBody(Body=dereq.Body)  # -> ContentType, Text, Bytes
db_2 = DeconstructBody(Body=dereq_2.Body)  # -> ContentType, Text, Bytes

# ---- group: Request Content
txt = Text(db.Text)

txt_2 = Text(db_2.Text)

# ----
pjs = ParseJSONString(Text=txt)
pjs_2 = ParseJSONString(Text=txt_2)
gjok = GetJSONObjectKey(JObject=pjs, Key="num_points")
gjok_2 = GetJSONObjectKey(JObject=pjs, Key="box_size")
gjok_3 = GetJSONObjectKey(JObject=pjs_2, Key="num_points")
gjok_4 = GetJSONObjectKey(JObject=pjs_2, Key="box_size")
rjv = ReadJSONValue(JValue=gjok)  # -> AsString, AsNumber, AsBool
rjv_2 = ReadJSONValue(JValue=gjok_2)  # -> AsString, AsNumber, AsBool
rjv_3 = ReadJSONValue(JValue=gjok_3)  # -> AsString, AsNumber, AsBool
rjv_4 = ReadJSONValue(JValue=gjok_4)  # -> AsString, AsNumber, AsBool
box = DomainBox(Base=PlaneXY(0, 0, 0), X=rjv_2.AsNumber, Y=rjv_2.AsNumber, Z=rjv_2.AsNumber)
box_2 = DomainBox(Base=PlaneXY(0, 0, 0), X=rjv_4.AsNumber, Y=rjv_4.AsNumber, Z=rjv_4.AsNumber)
pop3d = Populate3D(Region=box, Count=rjv.AsNumber, Seed=1)
pop3d_2 = Populate3D(Region=box_2, Count=rjv_3.AsNumber, Seed=1)
voronoi³ = Voronoi3D(Points=pop3d)  # -> Cells, Boundary
voronoi³_2 = Voronoi3D(Points=pop3d_2)  # -> Cells, Boundary
area = Area(Geometry=voronoi³.Cells)  # -> Area, Centroid
area_2 = Area(Geometry=voronoi³_2.Cells)  # -> Area, Centroid
scale = Scale(Geometry=voronoi³.Cells, Center=area.Centroid, Factor=0.8)  # -> Geometry, Transform
scale_2 = Scale(Geometry=voronoi³_2.Cells, Center=area_2.Centroid, Factor=0.8)  # -> Geometry, Transform
volume = Volume(Geometry=scale.Geometry)  # -> Volume, Centroid
ma = MassAddition(Input=volume.Volume)  # -> Result, PartialResults
area_3 = Area(Geometry=scale_2.Geometry)  # -> Area, Centroid
ma_2 = MassAddition(Input=area_3.Area)  # -> Result, PartialResults
cjv = CreateJSONValue(Value=ma.Result)
cjv_2 = CreateJSONValue(Value=ma_2.Result)
cjo = CreateJSONObject(Keys="volume", Values=cjv)
cjo_2 = CreateJSONObject(Keys="area", Values=cjv_2)

# ---- group: Server Response Body
ctb = CreateTextBody(Content=cjo, IsHtmlChecked=False, IsJavascriptChecked=False, IsJsonChecked=True, IsTextChecked=False, IsXmlChecked=False)

ctb_2 = CreateTextBody(
    Content=cjo_2,
    IsHtmlChecked=False,
    IsJavascriptChecked=False,
    IsJsonChecked=True,
    IsTextChecked=False,
    IsXmlChecked=False)

# ----
sr = ServerResponse(Request=dereq.Request, Body=ctb, Status=200)
sr_2 = ServerResponse(Request=dereq_2.Request, Body=ctb_2, Status=200)
