# Grasshopper definition get-headers.gh (Grasshopper 1.0.7)
# plug-ins: Swiftlet

url = Panel("https://httpbin.org/get")
value = Panel("Europe/Amsterdam")
key = Panel("timeZone")
ch = CreateHttpHeader(Key=key, Value=value)
get = GETRequest(URL=url, Headers=ch)  # -> Status, Content, Response
fjs = FormatJsonString(JSONString=get.Content)
json = Panel(fjs)
status_code = Panel(get.Status)
