# Grasshopper definition get-query-params.gh (Grasshopper 1.0.7)
# plug-ins: Swiftlet

url = Panel("https://timeapi.io/api/Time/current/zone")
value = Panel("Europe/Amsterdam")
key = Panel("timeZone")
cqp = CreateQueryParam(Key=key, Value=value)
get = GETRequest(URL=url, Params=cqp)  # -> Status, Content, Response
fjs = FormatJsonString(JSONString=get.Content)
json = Panel(fjs)
status_code = Panel(get.Status)
