# Grasshopper definition get-simple.gh (Grasshopper 1.0.7)
# plug-ins: Swiftlet

url = Panel("http://worldtimeapi.org/api/timezone/America/New_York")
get = GETRequest(URL=url)  # -> Status, Content, Response
fjs = FormatJsonString(JSONString=get.Content)
json = Panel(fjs)
status_code = Panel(get.Status)
