# Grasshopper definition html-parsing-simple.gh (Grasshopper 1.0.7)
# plug-ins: Swiftlet

# ----
# SELECTING AN ELEMENT BY ID
html = Panel("""<!DOCTYPE html>
<html>
<body>

<h1>My First Heading</h1>
<p>My first paragraph.</p>
<ul id="personal-data">
  <li itemprop="name">Thomas Anderson</li>
  <li itemprop="email">thomas.anderson@protonmail.com</li>
  <li itemprop="telephone">(917) 123-4567</li>
</ul>

</body>
</html>""")
html_2 = ReadHTML(HTML=html)
panel = Panel(html_2)
byid = GetElementById(Parent=html_2, ID="personal-data")
panel_2 = Panel(byid)
bytag = GetElementsByTagName(Parent=byid, Tag="li", Recursive=True)
inner = GetInnerHTML(Node=bytag)
panel_3 = Panel(inner)

# ----
# GETTING ELEMENT ATTRIBUTES
# Getting all element
# attributes and values
# Getting a specific
# attribute value
# Selecting an element
# by an attribute value
html_3 = Panel("""<!DOCTYPE html>
<html>
<body>

<h1>My First Heading</h1>
<p>My first paragraph.</p>
<ul id="personal-data">
  <li itemprop="name" class="list-item">Thomas Anderson</li>
  <li itemprop="email" class="list-item">thomas.anderson@protonmail.com</li>
  <li itemprop="telephone" class="list-item">(917) 123-4567</li>
</ul>
<div>
  <span class="card">
    Some content here
  </span>
  <span class="card">
    Some more content here
  </span>
</div>

</body>
</html>""")
html_4 = ReadHTML(HTML=html_3)
panel_4 = Panel(html_4)
bytag_2 = GetElementsByTagName(Parent=html_4, Tag="li", Recursive=True)
byattr = GetElementsByAttributeValue(Parent=html_4, Attribute="itemprop", Value="name", Recursive=True)
item = ListItem(List=bytag_2, Index=0, Wrap=True)
panel_5 = Panel(bytag_2)
panel_6 = Panel(byattr)
gattr = GetAttributeValue(Node=item, Attribute="itemprop")
gattrs = GetHtmlAttributes(Node=item)  # -> Names, Values
inner_2 = GetInnerHTML(Node=byattr)
attribute_value = Panel(gattr)
attribute_keys = Panel(gattrs.Names)
attribute_values = Panel(gattrs.Values)
panel_7 = Panel(inner_2)

# ----
# SELECTING ELEMENTS BY ATTRIBUTE VALUE
html_5 = Panel("""<!DOCTYPE html>
<html>
<body>

<h1>My First Heading</h1>
<p>My first paragraph.</p>
<ul>
  <li itemprop="name">Thomas Anderson</li>
  <li itemprop="email">thomas.anderson@protonmail.com</li>
  <li itemprop="telephone">(917) 123-4567</li>
</ul>

</body>
</html>""")
html_6 = ReadHTML(HTML=html_5)
panel_8 = Panel(html_6)
byattr_2 = GetElementsByAttributeValue(Parent=html_6, Attribute="itemprop", Value="name", Recursive=True)
byattr_3 = GetElementsByAttributeValue(Parent=html_6, Attribute="itemprop", Value="email", Recursive=True)
byattr_4 = GetElementsByAttributeValue(Parent=html_6, Attribute="itemprop", Value="telephone", Recursive=True)
inner_3 = GetInnerHTML(Node=byattr_2)
inner_4 = GetInnerHTML(Node=byattr_4)
panel_9 = Panel(byattr_2)
panel_10 = Panel(byattr_3)
inner_5 = GetInnerHTML(Node=byattr_3)
panel_11 = Panel(byattr_4)
panel_12 = Panel(inner_3)
panel_13 = Panel(inner_5)
panel_14 = Panel(inner_4)

# ----
# SELECTING ELEMENTS BY CLASS NAME
html_7 = Panel("""<!DOCTYPE html>
<html>
<body>

<h1>My First Heading</h1>
<p>My first paragraph.</p>
<ul id="personal-data">
  <li itemprop="name">Thomas Anderson</li>
  <li itemprop="email">thomas.anderson@protonmail.com</li>
  <li itemprop="telephone">(917) 123-4567</li>
</ul>
<span class="card">
  Some content here
</span>
<span class="card">
  Some more content here
</span>

</body>
</html>""")
html_8 = ReadHTML(HTML=html_7)
panel_15 = Panel(html_8)
byclass = GetElementsByClassName(Parent=html_8, Class="card", Recursive=True)
inner_6 = GetInnerHTML(Node=byclass)
panel_16 = Panel(byclass)
panel_17 = Panel(inner_6)

# ----
# SELECTING ELEMENTS BY XPATH
html_9 = Panel("""<!DOCTYPE html>
<html>
<body>

<h1>My First Heading</h1>
<p>My first paragraph.</p>
<ul id="personal-data">
  <li itemprop="name">Thomas Anderson</li>
  <li itemprop="email">thomas.anderson@protonmail.com</li>
  <li itemprop="telephone">(917) 123-4567</li>
</ul>
<div>
  <span class="card">
    Some content here
  </span>
  <span class="card">
    Some more content here
  </span>
</div>

</body>
</html>""")
html_10 = ReadHTML(HTML=html_9)
panel_18 = Panel(html_10)
byxpath = GetElementsByXPATH(Parent=html_10, XPATH="//span[@class='card']")
inner_7 = GetInnerHTML(Node=byxpath)
panel_19 = Panel(byxpath)
panel_20 = Panel(inner_7)

# ----
# PARSING AN HTML DOCUMENT
# GETTING ALL CHILD NODES
html_11 = Panel("""<!DOCTYPE html>
<html>
<body>

<h1>My First Heading</h1>
<p>My first paragraph.</p>

</body>
</html>""")
html_12 = ReadHTML(HTML=html_11)
panel_21 = Panel(html_12)
gch = GetChildNodes(Parent=html_12)
panel_22 = Panel(gch)

# ----
# STRINGIFYING AN HTML NODE
html_13 = Panel("""<!DOCTYPE html>
<html>
<body>

<h1>My First Heading</h1>
<p>My first paragraph.</p>
<ul>
  <li>Coffee</li>
  <li>Tea</li>
  <li>Milk</li>
</ul>

</body>
</html>""")
html_14 = ReadHTML(HTML=html_13)
bytag_3 = GetElementsByTagName(Parent=html_14, Tag="li", Recursive=True)
panel_23 = Panel(html_14)
item_2 = ListItem(List=bytag_3, Index=0, Wrap=True)
inner_8 = GetInnerHTML(Node=item_2)
panel_24 = Panel(item_2)
shtml = StringifyHTMLNode(HTMLNode=item_2)
innerhtml = Panel(inner_8)
outerhtml = Panel(shtml)

# ----
# SELECTING ELEMENTS BY TAG
html_15 = Panel("""<!DOCTYPE html>
<html>
<body>

<h1>My First Heading</h1>
<p>My first paragraph.</p>
<ul>
  <li>Coffee</li>
  <li>Tea</li>
  <li>Milk</li>
</ul>

</body>
</html>""")
html_16 = ReadHTML(HTML=html_15)
bytag_4 = GetElementsByTagName(Parent=html_16, Tag="li", Recursive=True)
panel_25 = Panel(html_16)
inner_9 = GetInnerHTML(Node=bytag_4)
panel_26 = Panel(bytag_4)
panel_27 = Panel(inner_9)
