# Grasshopper definition json-casting.gh (Grasshopper 1.0.7)
# plug-ins: Swiftlet

panel = Panel("""[
  "hello",
  "world"
]""")
panel_2 = Panel("""{
  "key" : "value"
}""")
pjs = ParseJSONString(Text=panel)
pjs_2 = ParseJSONString(Text=panel_2)
pjs_3 = ParseJSONString(Text="\"value\"")
jo = JObject(pjs_2)
ja = JArray(pjs)
jv = JValue(pjs_3)
panel_3 = Panel(ja)
panel_4 = Panel(jo)
panel_5 = Panel(jv)
