# Grasshopper definition json-parsing-complex.gh (Grasshopper 1.0.7)
# plug-ins: Swiftlet

panel = Panel("""{
  "number_value": 5.8,
  "int_value": 50,
  "bool_value": false,
  "array_value": [
    {
      "start" : 0,
      "end": 10
    },
    {
      "start": 9,
      "end": 21
    }
  ],
  "polyline" : {
    "name": "My Polyline",
    "color": "#0330fc",
    "points": [
      [12, 24, 0],
      [12, 45, 0],
      [14, 47, 0]
    ]
  }
}""")
pjs = ParseJSONString(Text=panel)
jo = JObject(pjs)
gjok = GetJSONObjectKey(JObject=jo, Key="polyline")
gjok_2 = GetJSONObjectKey(JObject=jo, Key="array_value")
gjok_3 = GetJSONObjectKey(JObject=jo, Key="number_value")
rjo = ReadJSONObject(JObject=jo)  # -> Keys, JTokens
ja = JArray(gjok_2)
jv = JValue(gjok_3)
keys = Panel(rjo.Keys)
jo_2 = JObject(gjok)
rja = ReadJSONArray(Array=ja)
rjv = ReadJSONValue(JValue=jv)  # -> AsString, AsNumber, AsBool
rjo_2 = ReadJSONObject(JObject=jo_2)  # -> Keys, JTokens
panel_2 = Panel(rjo_2.JTokens)
panel_3 = Panel(rjo_2.Keys)
number = Panel(rjv.AsNumber)
panel_4 = Panel(rja)
jo_3 = JObject(rja)
rjo_3 = ReadJSONObject(JObject=jo_3)  # -> Keys, JTokens
sjt = SeparateJSONTokens(JTokens=rjo_2.JTokens)  # -> JObjects, JArrays, JValues
panel_5 = Panel(rjo_3.Keys)
panel_6 = Panel(rjo_3.JTokens)
rjv_2 = ReadJSONValue(JValue=sjt.JValues)  # -> AsString, AsNumber, AsBool
ja_2 = JArray(sjt.JArrays)
jv_2 = JValue(rjo_3.JTokens)
rja_2 = ReadJSONArray(Array=ja_2)
panel_7 = Panel(rjv_2.AsString)
rjv_3 = ReadJSONValue(JValue=jv_2)  # -> AsString, AsNumber, AsBool
panel_8 = Panel(rja_2)
rja_3 = ReadJSONArray(Array=rja_2)
number_2 = Panel(rjv_3.AsNumber)
rjv_4 = ReadJSONValue(JValue=rja_3)  # -> AsString, AsNumber, AsBool
panel_9 = Panel(rjv_4.AsNumber)
