# Grasshopper definition json-parsing-simple.gh (Grasshopper 1.0.7)
# plug-ins: Swiftlet

json = Panel("""{
  "string": "Hello World",
  "number": 10,
  "bool": true
}""")
pjs = ParseJSONString(Text=json)
panel = Panel(pjs)
rjo = ReadJSONObject(JObject=pjs)  # -> Keys, JTokens
keys = Panel(rjo.Keys)
values = Panel(rjo.JTokens)
rjv = ReadJSONValue(JValue=rjo.JTokens)  # -> AsString, AsNumber, AsBool
as_string = Panel(rjv.AsString)
as_number = Panel(rjv.AsNumber)
as_boolean = Panel(rjv.AsBool)
