# Grasshopper definition multipart-form-data.gh (Grasshopper 1.0.7)
# plug-ins: Swiftlet

panel = Panel("""name
email""")
panel_2 = Panel("""John Doe
jsoe@gmail.com""")

# ---- group: Path to a PNG Image
# Named Fields
path = FilePath()

# ----
panel_3 = Panel("""name
email""")
panel_4 = Panel("""John Doe
jsoe@gmail.com""")

# ---- group: Path to a PNG Image
# Unnamed Fields
path_2 = FilePath()

# ----
cjv = CreateJSONValue(Value=panel_2)
cjv_2 = CreateJSONValue(Value=panel_4)
cjo = CreateJSONObject(Keys=panel, Values=cjv)
cjo_2 = CreateJSONObject(Keys=panel_3, Values=cjv_2)
field_names = Panel("""image-data
some-json-object""")
ctb = CreateTextBody(Content=cjo, IsHtmlChecked=False, IsJavascriptChecked=False, IsJsonChecked=True, IsTextChecked=False, IsXmlChecked=False)
babff = CreateByteArrayBodyFromFile(Path=path, ContentType="image/png")
ctb_2 = CreateTextBody(
    Content=cjo_2,
    IsHtmlChecked=False,
    IsJavascriptChecked=False,
    IsJsonChecked=True,
    IsTextChecked=False,
    IsXmlChecked=False)
babff_2 = CreateByteArrayBodyFromFile(Path=path_2, ContentType="image/png")
merge = Merge(Data1=babff, Data2=ctb)
merge_2 = Merge(Data1=babff_2, Data2=ctb_2)
url = Panel("https://httpbin.org/post")
url_2 = Panel("https://httpbin.org/post")
cmfbn = CreateMultipartFormBodyNamed(Keys=field_names, Fields=merge)
panel_5 = Panel(cmfbn)
cmfbu = CreateMultipartFormBodyUnnamed(Fields=merge_2)
post = POSTRequest(URL=url, Body=cmfbn)  # -> Status, Content, Response
post_2 = POSTRequest(URL=url_2, Body=cmfbu)  # -> Status, Content, Response
panel_6 = Panel(post.Content)
panel_7 = Panel(post_2.Content)
