# Grasshopper definition post-simple.gh (Grasshopper 1.0.7)
# plug-ins: Swiftlet

url = Panel("https://timeapi.io/api/Conversion/ConvertTimeZone")
body = Panel("""{
    "fromTimeZone": "Europe/Amsterdam",
    "dateTime": "2021-03-14 17:45:00",
    "toTimeZone": "America/Los_Angeles",
    "dstAmbiguity": ""
}""")
ctb = CreateTextBody(
    Content=body,
    IsHtmlChecked=False,
    IsJavascriptChecked=False,
    IsJsonChecked=True,
    IsTextChecked=False,
    IsXmlChecked=False)
post = POSTRequest(URL=url, Body=ctb)  # -> Status, Content, Response
fjs = FormatJsonString(JSONString=post.Content)
json = Panel(fjs)
status_code = Panel(post.Status)
